# Grasshopper definition 2023-06-24_Seismic Design Demand - v5.8.gh (Grasshopper 1.0.7)
# plug-ins: MeshEdit Components, ShapeDiverForGrasshopper

enter_address = DirectTextInput(maxlength=10000, text="Default")
sddp = ShapeDiverDocumentPayload({AbsoluteTolerance=0, AngleTolerance=0, DistanceDisplayPrecision=0, GltfVersion="Gltf2", GrasshopperVersion="1.0.0007", InputGroups="{}", OutputGroups="{}", RelativeTolerance=0, RhinoVersion="7.29.23107.3001", UnitSystem=0, VersionCreated="1.14.0.0", VersionSaved="1.14.0.0"})
panel = Panel(enter_address)
enter_address_2 = Panel("301 howard street, San Francisco, CA")
get_buildings_footprint = BooleanToggle(False)
get_location = BooleanToggle(False)
get_3d_buildings = BooleanToggle(False)
panel_2 = Panel("abd1c277b888194d037e760ffb459da4")
radius = ValueList({"200", "300", "400", "500"}, selected="300")
gismo = Gismo_Gismo(gismoFolder="c:\gismo")  # -> readMe; plug-in component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

# ---- group: ShapeDiverUnits
tolerance = ToleranceSettings(AbsoluteTolerance=0.001, RelativeTolerance=1, AngleTolerance=1, UnitSystem=9)

# ----
num = Number(radius)
addresstolocation = Gismo_AddressToLocation(address=enter_address_2, openweb=get_location)  # -> readMe, location, weblink; inputs openweb: Boolean; plug-in component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
panel_3 = Panel(addresstolocation.location)

# ---- group: buildings
# 2d shapes
osmobjects = Gismo_OSMObjects({"Building", "Commercial building", "Residential building", "Office building", "Office administrative", "Office government", "Post office", "Hospital", "Ambulance station", "Pharmacy"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}, selected="Building")
osmkeys = Gismo_OSMKeys(OSMobjectName=osmobjects)  # -> readMe, requiredKeys, OSMwebpage; inputs OSMobjectName: list; plug-in component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
osmshapes = Gismo_OSMShapes(
    location=addresstolocation.location,
    radius=num,
    shapeType="0",
    requiredKeys=osmkeys.requiredKeys,
    bakeIt=False,
    runIt=get_buildings_footprint)  # -> readMe, shapes, keys, values, port, titleOriginPt, title; inputs radius: Int32, origin: Point3d, shapeType: Int32, requiredKeys: list, onlyRemove_Ids: tree, bakeIt: Boolean, runIt: Boolean; plug-in component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

# ----
osm3d = Gismo_OSM3D(shapes=osmshapes.shapes, keys=osmshapes.keys, values=osmshapes.values, treeType=2, bakeIt=False, runIt=get_3d_buildings)  # -> readMe, threeDeeShapes, threeDeeKeys, threeDeeValues, height; inputs shapes: tree of GeometryBase, keys: list, values: tree, onlyRemove_Ids: tree, treeType: Int32, groundTerrain: Brep, bakeIt: Boolean, runIt: Boolean; plug-in component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

# ---- group: Get Height in Feet
tmatch = MatchText(Text=osmshapes.keys, Pattern="height", Case=True)
dispatch = Dispatch(List=osmshapes.values, DispatchPattern=tmatch)  # -> ListA, ListB
mindex = MemberIndex(Set=dispatch.ListA)  # -> Index, Count
num_2 = Number(mindex.Index)
num_3 = Number("0")
num_4 = Number("1")
replace = ReplaceMembers(Set=num_2, Find=num_3, Replace=num_4)
cull_i = CullIndex(List=dispatch.ListA, Indices=mindex.Index, Wrap=True)  # -> simplify(List)
combine = CombineData(Input0=cull_i, Input1=replace)  # -> simplify(Result), Index
split = TextSplit(Text=combine.Result, Separators=" ")
item = ListItem(List=split, Index=0, Wrap=True)
split_2 = TextSplit(Text=item, Separators="\"")  # -> simplify(Result)
mindex_2 = MemberIndex(Set=split_2)  # -> Index, Count
cull_i_2 = CullIndex(List=split_2, Indices=mindex_2.Index, Wrap=True)
replace_2 = ReplaceMembers(Set=cull_i_2, Find="0")  # -> flatten(Result)
tmatch_2 = MatchText(Text=graft(replace_2), RegEx="'", Case=True)  # -> simplify(Match)
graft = GraftTree(Tree=replace_2, IncludeEmptyLists=True, IncludeNullItems=True)  # -> simplify(Tree)
dispatch_2 = Dispatch(List=graft(replace_2), DispatchPattern=tmatch_2)  # -> simplify(ListA), ListB
split_3 = TextSplit(Text=dispatch_2.ListA, Separators="'")
clean = CleanTree(RemoveNulls=True, RemoveInvalid=True, RemoveEmpty=True, Tree=split_3)
item_2 = ListItem(List=clean, Index=0, Wrap=True)  # -> Item, Item1
num_5 = Number(item_2.Item1)
num_6 = Number(item_2.Item)
expression = Expression(x=num_6, y=num_5, Expression="(x*12)+y")  # -> simplify(R)
tstat = TreeStatistics(Tree=expression)  # -> Paths, Length, Count
split_4 = SplitTree(Data=graft, Masks=flatten(tstat.Paths))  # -> Positive, Negative
multiplication = Multiplication(A=split_4.Negative, B="3.28084")
round = Round(Number=expression)  # -> Nearest, Floor, Ceiling
round_2 = Round(Number=multiplication)  # -> Nearest, Floor, Ceiling
merge = Merge(Data1=round_2.Nearest, Data2=round.Nearest)

# ----
crv = Curve(osmshapes.shapes)
sdmaterial = ShapeDiverMaterial(Color=ColourSwatch(SwatchColor=RGB(138, 138, 138)), FlatShading=False)
mesh = Mesh(osm3d.threeDeeShapes)
sddisplay = ShapeDiverDisplay(Geometry=flatten([mesh, crv]), ShapeDiverMaterial=sdmaterial)

# ---- group: Building Mesh
crv_2 = Curve(simplify(osmshapes.shapes))
join = JoinCurves(Curves=crv_2, Preserve=False)  # -> flatten(Curves)
Z = UnitZ(Factor=merge)
move = Move(Geometry=join, Motion=flatten(Z))  # -> Geometry, Transform
merge_2 = Merge(Data1=simplify(graft(join)), Data2=simplify(graft(move.Geometry)))
m_loft = MeshLoft(P=merge_2, T=0, O=False, F=False, C=True)  # -> out, M; inputs P: list of Curve, clr: list
# ---------- m_loft: VB ----------
    Component.Params.Input(0).Name = "Curves"
    Component.Params.Input(0).Description = "A list of open or closed curves"
    Component.Params.Input(1).Name = "Face Type"
    Component.Params.Input(1).Description = "0=Quad, 1=Triangulate, 2=Zig Zag, 3=Wave, 4=Diamond, 5=Shortest, 6=Longest"
    Component.Params.Input(2).Name = "Attempt Orientation"
    Component.Params.Input(2).Description = "An optional boolean input which if true will attempt to shift each curves control points to reduce torsion"
    Component.Params.Input(3).Name = "Flip"
    Component.Params.Input(3).Description = "An optional boolean input which if true will reverse the direction of triangulation when possible"
    Component.Params.Input(4).Name = "Closed"
    Component.Params.Input(4).Description = "An optional boolean input which if true will connect the last curve back to the first"
    Component.Params.Input(5).Name = "Color [Vertex]"
    Component.Params.Input(5).Description = "An optional color or list of colors corresponding to each new vertex of the mesh"

    Component.Params.Output(1).Name = "Mesh"
    Component.Params.Output(1).Description = "If successful, a valid mesh"

    If P.count() > 1 Then
      Dim MO As New mesh
      Dim mt As New mesh
      Dim i,j,k,r,s,n,u,v,w,x,y As Integer
      Dim arrFc As New list(Of MeshFace)
      Dim arrClr As New list(Of color)
      Dim blnC As New list(Of Boolean)
      Dim us() As Integer
      Dim cen(2), tpt(1) As point3d
      Dim mv As Rhino.Geometry.Collections.MeshVertexList
      Dim oc As New list(Of color)
      mv = mt.Vertices

      'Optional Colors
      Dim tclr As New datatree(Of color)
      Dim tcx As Integer
      For j = 0 To P.count() - 1 Step 1
        Dim tncr As New nurbscurve(P.item(j).tonurbscurve)
        Dim tpln As New polyline(tncr.Points.ControlPolygon())

        Dim cs As New dictionary(Of Integer,Object)
        Dim blnX As New Boolean
        If ((j > clr.count()) Or (clr.count() = 0)) Then
          cs.add(0, color.White)
          cs.add(1, color.White)
        Else
          cs = clr.item(j)
          If cs.count() > 0 Then blnX = True
        End If

        If blnX Then
          For k = 0 To cs.count() - 2 Step 1
            tclr.add(color.FromArgb(cs.item(k).R, cs.item(k).G, cs.item(k).B), New gh_path(j))
          Next
        End If

        If tpln.count() > cs.count() Then
          tcx = cs.count() - 1
          For k = cs.count() To tpln.count() - 2 Step 1
            tclr.add(color.FromArgb(cs.item(tcx).R, cs.item(tcx).G, cs.item(tcx).B), New gh_path(j))
          Next
        End If
      Next

      'Vertices
      s = 0
      If C Then y = 0 Else y = 1
      If f Then x = 0 Else x = 1
      For i = 0 To P.count() - y Step 1
        If i < P.count() Then
          Dim ncrv As New nurbscurve(P.item(i).tonurbscurve())
          Dim npts As Rhino.Geometry.Collections.NurbsCurvePointList
          npts = ncrv.Points()
          Dim pline As polyline = npts.ControlPolygon
          cen(1) = pline.CenterPoint
          If i = 0 Then cen(2) = cen(1)
          If P.item(i).IsClosed() Then
            pline.RemoveAt(pline.Count() - 1)
            blnC.add(True)
          Else
            blnC.add(False)
          End If
          v = pline.Count() - 1
          If o Then
            If (i > 0) Then
              If (blnC.item(i) And blnC.item(i - 1)) Then pline = radSrtPt(cen(1), tpt(0), tpt(1), cen(0), pline)(0)
            Else
              Dim ncrvA As New nurbscurve(P.item(1).tonurbscurve())
              Dim plineA As polyline = ncrvA.points.ControlPolygon
              If P.item(1).IsClosed() Then plineA.RemoveAt(plineA.Count() - 1)
              If (blnC.item(i) And P.item(1).isclosed()) Then pline = radSrtPt(plineA.CenterPoint, pline.item(0), pline.item(pline.count() - 1), pline.CenterPoint, pline)(0)
            End If
          End If

          tpt(0) = pline.item(0)
          tpt(1) = pline.item(pline.count() - 1)
          cen(0) = cen(1)

          mv.AddVertices(pline.ToArray())
          oc.addrange(tclr.branch(i))
          n = s
          us = Series(pline.count() - 1)
        Else
          If o Then
            Dim ncrvA As New nurbscurve(P.item(0).tonurbscurve())
            Dim plineA As polyline = ncrvA.points.ControlPolygon
            If P.item(0).IsClosed() Then plineA.RemoveAt(plineA.Count() - 1)
            us = radSrtPt(cen(2), tpt(0), tpt(1), cen(0), plineA)(1)
          Else
            us = Series(r)
          End If
          n = -1
          If P.item(0).isclosed() Then blnC.add(True) Else blnC.add(False)
        End If

        Dim tu(),tv() As Integer
        If i > 0 Then
          If i = P.count() Then v = r
          If blnC.item(i) Then tv = appendprepend(v) Else tv = prepend(v)
          If blnC.item(i - 1) Then tu = appendprepend(u) Else tu = prepend(u)
          If ubound(tu) > ubound(tv) Then k = ubound(tu) Else k = ubound(tv)
          Dim blnU, blnV As New Boolean
          For j = 1 To k Step 1

            If ((j < ubound(tv)) And (j < ubound(tu))) Then
              'This is where faces with 4 valid vertices go

              Dim d(1) As Double
              Dim viD(3) As Double

              viD(0) = s - u + tu(j)
              viD(1) = s - u + tu(j + 1)
              viD(2) = n + 1 + us(tv(j + 1))
              viD(3) = n + 1 + us(tv(j))

              d(0) = mv.item(viD(0)).distanceto(mv.item(viD(2)))
              d(1) = mv.item(viD(1)).distanceto(mv.item(viD(3)))

              'set edge pattern
              If t = 1 Then'Triangulate
                w = x
              ElseIf t = 2 Then 'ZigZag
                If ((i + 1 + x) Mod 2) Then w = 1 Else w = 0
              ElseIf t = 3 Then 'Wave
                If ((j + 1 + x) Mod 2) Then w = 1 Else w = 0
              ElseIf t = 4 Then 'Diamond
                If ((i + 1 + x) Mod 2) Then
                  If ((j + 1) Mod 2) Then w = 1 Else w = 0
                Else
                  If ((j + 1) Mod 2) Then w = 0 Else w = 1
                End If
              ElseIf t = 5 Then 'Shortest
                If d(0) > d(1) Then w = 0 Else w = 1
              ElseIf t = 6 Then 'Longest Length
                If d(0) > d(1) Then w = 1 Else w = 0
              Else
                w = 2
              End If


              'Assign Faces
              If w = 0 Then
                arrFc.add(New meshface(viD(0), viD(1), viD(3)))
                arrFc.add(New meshface(viD(1), viD(2), viD(3)))
              ElseIf w = 1 Then
                arrFc.add(New meshface(viD(0), viD(1), viD(2)))
                arrFc.add(New meshface(viD(0), viD(2), viD(3)))
              Else
                arrFc.add(New meshface(viD(0), viD(1), viD(2), viD(3)))
              End If

            ElseIf ((j < ubound(tv))) Then
              arrFc.add(New meshface(s - u + tu(ubound(tu)), n + 1 + us(tv(j + 1)), n + 1 + us(tv(j))))
            ElseIf ((j < ubound(tu)))  Then
              arrFc.add(New meshface(s - u + tu(j), s - u + tu(j + 1), n + 1 + us(tv(ubound(tv)))))
            End If
          Next

        Else
          r = v
        End If
        u = v
        s = mv.count() - 1
      Next

      MO.Vertices.AddVertices(mv)
      If clr.count() > 0 Then MO.VertexColors.AppendColors(oc.toarray())
      MO.Faces.AddFaces(arrFc.toarray())
      MO.Normals.ComputeNormals()
      MO.FaceNormals.ComputeFaceNormals()

      M = MO
    End If
# ---------- m_loft: VB additional code ----------
  Private Function appendprepend(ByVal i As Integer)
    Dim srsEnum As IEnumerable(Of Integer) = Enumerable.Range(0, i + 1)
    Dim arrVal As New list(Of Integer)
    arrVal = srsEnum.tolist()
    arrVal.add(0)
    arrVal.insert(0, i)
    Return arrVal.toarray()
  End Function

  Private Function prepend(ByVal i As Integer)
    Dim srsEnum As IEnumerable(Of Integer) = Enumerable.Range(0, i + 1)
    Dim arrVal As New list(Of Integer)
    arrVal = srsEnum.tolist()
    arrVal.insert(0, i)
    Return arrVal.toarray()
  End Function

  Private Function Series(ByVal i As Integer)
    Dim srsEnum As IEnumerable(Of Integer) = Enumerable.Range(0, i + 1)
    Dim arrVal As New list(Of Integer)
    arrVal = srsEnum.tolist()
    Return arrVal.toarray()
  End Function

  Private Function radSrtPt(ByVal cenA As point3d, ByVal ptA As point3d, ByVal ptB As point3d, ByVal cenB As point3d, ByVal ptList As polyline)
    Dim i As Integer
    Dim arrOut() As point3d
    Dim vecA, vecB, vecC As New Vector3d
    vecA = (ptA + ptB) / 2 - cenB
    vecB = cenB - cenA
    vecC = vector3d.CrossProduct(vecB, vecA)

    Dim pln As New plane(cenB, vecB, vecA)
    pln = New plane(cenB, pln.YAxis, pln.ZAxis)
    Dim ptTemp As New list(Of point3d)
    Dim dblAng(),dblAngA() As Double
    Dim intSrt() As Integer

    ReDim dblAng(ptList.count() - 1)
    ReDim dblAngA(ptList.count() - 1)
    ReDim intSrt(ptList.count() - 1)

    For i = 0 To ptList.count() - 1 Step 1
      Dim vec As vector3d
      ptTemp.add(ptList.item(i))
      intSrt(i) = i
      vec = pln.ClosestPoint(ptList.item(i)) - cenA
      dblAng(i) = vector3d.VectorAngle(vec, pln.XAxis, pln)
      dblAngA(i) = dblAng(i)
    Next

    arrOut = ptTemp.toarray()
    array.Sort(dblAng, arrOut)
    array.Sort(dblAngA, intSrt)

    Dim plineO As New Polyline(arrOut)

    Return {plineO,intSrt}
  End Function
# ---------- end m_loft ----------
area = Area(Geometry=join)  # -> Area, Centroid

# ----
osmrendermesh = Gismo_OSMRenderMesh(defaultColor=RGB(217, 217, 217), textureImageName="textureImage", bakeIt=False, runIt=False)  # -> readMe, renderMesh, textureImagePath; inputs threeDeeShapes: tree of GeometryBase, threeDeeKeys: list, threeDeeValues: tree, defaultColor: Color, bakeIt: Boolean, runIt: Boolean; plug-in component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
panel_4 = Panel(merge)
Z_2 = UnitZ(Factor=1)
m_fill = FillMeshHoles(P=move.Geometry)  # -> out, M; inputs P: Curve, clr: list of Color
# ---------- m_fill: VB ----------
    Component.Params.Input(0).Name = "Curves"
    Component.Params.Input(0).Description = "A list of open or closed curves"
    Component.Params.Input(1).Name = "Vertex Color "
    Component.Params.Input(1).Description = "A an optional list of colors corresponding to each control point of the input curve, and additional color can be added for the center of the new mesh."

    Component.Params.Output(1).Name = "Mesh"
    Component.Params.Output(1).Description = "If successful, a valid mesh"

    If P IsNot Nothing Then
      Dim ncrv As NurbsCurve
      Dim npts As rhino.Geometry.Collections.NurbsCurvePointList
      Dim pline As polyline

      Dim avgClr,tclr As color
      Dim ov As New list(Of point3d)
      Dim oc As New list(Of Color)
      Dim ofc As New list(Of MeshFace)

      Dim i,j As Integer
      ncrv = P.ToNurbsCurve()
      npts = ncrv.Points
      pline = npts.ControlPolygon

      ov = pline.toarray().ToList()
      If P.IsClosed() Then ov.removeat(ov.count() - 1)
      j = ov.count() - 1
      ov.add(pline.CenterPoint)

      For i = 0 To j Step 1
        If (clr.count()) > 0 Then
          If i > (clr.count() - 1) Then tclr = clr.item(clr.count() - 1) Else tclr = clr.item(i)
          If i = 0 Then avgClr = tclr Else avgClr = colorAverage(avgClr, tclr, 0.5)
          oc.add(tclr)
        End If

        If ((i = j) And (P.IsClosed())) Then
          ofc.add(New meshface(i, 0, j + 1))
        Else
          ofc.add(New meshface(i, i + 1, j + 1))
        End If
      Next

      If (clr.count()) > 0 Then If(j + 1) = (clr.count() - 1) Then oc.add(clr.item(j + 1)) Else oc.add(avgClr)

      Dim msh As New mesh
      msh.Vertices.AddVertices(ov.toarray())
      msh.Faces.AddFaces(ofc.toarray())
      If (clr.count()) > 0 Then msh.VertexColors.AppendColors(oc.toarray())

      M = msh
    End If
# ---------- m_fill: VB additional code ----------
  Function colorAverage(ByVal clrA As color, ByVal clrB As color, ByVal t As Double)
    Dim clrOut As color
    Dim R,G,B As Integer

    If CInt(clrA.r * t + clrB.r * (1 - t)) > 255 Then
      R = 255
    ElseIf CInt(clrA.r * t + clrB.r * (1 - t)) < 0 Then
      R = 0
    Else
      R = CInt(clrA.r * t + clrB.r * (1 - t))
    End If

    If CInt(clrA.g * t + clrB.g * (1 - t)) > 255 Then
      G = 255
    ElseIf CInt(clrA.g * t + clrB.g * (1 - t)) < 0 Then
      G = 0
    Else
      G = CInt(clrA.g * t + clrB.g * (1 - t))
    End If

    If CInt(clrA.b * t + clrB.b * (1 - t)) > 255 Then
      B = 255
    ElseIf CInt(clrA.b * t + clrB.b * (1 - t)) < 0 Then
      B = 0
    Else
      B = CInt(clrA.b * t + clrB.b * (1 - t))
    End If

    clrOut = color.fromargb(R, G, B)
    Return clrOut
  End Function
# ---------- end m_fill ----------
m_fill_2 = FillMeshHoles(P=join)  # -> out, M; inputs P: Curve, clr: list of Color; same code as m_fill
m_offset_extrude = MeshOffsetExtrude(M=simplify(graft(join)), B=False, E=True, C0=False, C1=True, V=Z_2, D=Z)  # -> out, A; inputs M: Mesh, V: list of Vector3d, D: list
# ---------- m_offset_extrude: VB ----------
    Component.Params.Input(0).Name = "Mesh"
    Component.Params.Input(0).Description = "Open or closed mesh"
    Component.Params.Input(1).Name = "Both Sides"
    Component.Params.Input(1).Description = "If true the mesh is offset in both directions along the vertex normals"
    Component.Params.Input(2).Name = "Edges"
    Component.Params.Input(2).Description = "If true the mesh will contain faces on the edges between the two offset mesh faces"
    Component.Params.Input(3).Name = "Closed Bottom"
    Component.Params.Input(3).Description = "If true the mesh will be closed on the origin face"
    Component.Params.Input(4).Name = "Closed Top"
    Component.Params.Input(4).Description = "If true the mesh will be closed on the offset face"
    Component.Params.Input(5).Name = "Vector [Vertex]"
    Component.Params.Input(5).Description = "An optional vector that sets the direction of extrusion, if empty, the new mesh will be offset along the vertex normals"
    Component.Params.Input(6).Name = "Distance [Vertex, Rh Units]"
    Component.Params.Input(6).Description = "A single number or list of numbers corresponding to each vertex of a mesh which sets the Rhino unit based distance that the new geometry is offset from each mesh face"

    Component.Params.Output(1).Name = "Mesh"
    Component.Params.Output(1).Description = "If successful, a valid mesh"

    If m IsNot Nothing Then

      Dim mf As Rhino.Geometry.Collections.MeshFaceList = Nothing
      Dim mv As Rhino.Geometry.Collections.MeshVertexList = Nothing
      Dim mtv As Rhino.Geometry.Collections.MeshTopologyVertexList = Nothing
      Dim mte As Rhino.Geometry.Collections.MeshTopologyEdgeList = Nothing
      Dim mn As Rhino.Geometry.Collections.MeshVertexNormalList = Nothing
      Dim mc As Rhino.Geometry.Collections.MeshVertexColorList = Nothing

      mf = m.Faces
      mv = m.Vertices
      mtv = m.TopologyVertices
      mte = m.TopologyEdges
      mn = m.Normals
      mc = m.VertexColors

      Dim clrB As Boolean = False
      If mc.count() > 0 Then clrB = True

      Dim i,cv,cf,u(1),hd As Integer
      Dim blnV As Boolean
      Dim vec As vector3d
      Dim ova, ovb As New list(Of point3d)
      Dim vf As New list(Of Vector3f)
      Dim ofc As New list(Of MeshFace)
      If b Then hd = 2 Else hd = 1
      
      cv = mv.count()
      cf = mf.count()

      If (D.count() - 1) < cv Then D = matchDbl(D, cv)

      If v.count() > 0 Then
        blnV = True
        If (V.count() - 1) < cv Then V = matchVec(V, cv)
      End If

      'Define Base Vertices
      For i = 0 To cv - 1 Step 1
        If blnV Then vec = V(i) Else vec = mn(i)
        vec.Unitize()
        vec *= (D(i) / hd)

        ovb.add(New point3d(mv(i)) + vec)
        If Not b Then vec *= 0
        vec.Reverse()
        ova.add(New point3d(mv(i)) + vec)
      Next

      If (c0 Or (((Not c0) And (Not e)) And c1)) Then ofc = mf.ToList()

      If ((e or c0) And c1) Then
        For i = 0 To cf - 1 Step 1
          If mf(i).isquad() Then
            ofc.add(New meshface(mf(i).A + cv, mf(i).B + cv, mf(i).C + cv, mf(i).D + cv))
          Else
            ofc.add(New meshface(mf(i).A + cv, mf(i).B + cv, mf(i).C + cv))
          End If
        Next
      End If

      If e Then
        For i = 0 To mte.count() - 1 Step 1

          u(0) = mtv.MeshVertexIndices(mte.GetTopologyVertices(i).I)(0)
          u(1) = mtv.MeshVertexIndices(mte.GetTopologyVertices(i).J)(0)

          If uBound(mte.GetConnectedFaces(i)) < 1 Then
            ofc.add(New meshface(u(0), u(1), u(1) + cv, u(0) + cv))
          End If
        Next
      End If

      Dim mo As New mesh

      If (c0 Or e) Then
        mo.Vertices.AddVertices(ova.toarray())
        If clrB Then mo.VertexColors.AppendColors(mc.ToArray())
      End If
      If (c1 Or e) Then
        mo.Vertices.AddVertices(ovb.toarray())
        If clrB Then mo.VertexColors.AppendColors(mc.ToArray())
      End If

      mo.Faces.AddFaces(ofc)

      A = mo
    End If
# ---------- m_offset_extrude: VB additional code ----------
  Private Function matchDbl(ByVal a As list(Of Double), ByVal t As Integer)
    Dim i,k As Integer
    k = a.count()
    For i = 0 To ((t + 1) - k) - 1 Step 1
      a.add(a.item(k - 1))
    Next
    Return a
  End Function

  Private Function matchVec(ByVal a As list(Of vector3d), ByVal t As Integer)
    Dim i,k As Integer
    k = a.count()
    For i = 0 To ((t + 1) - k) - 1 Step 1
      a.add(a.item(k - 1))
    Next
    Return a
  End Function
# ---------- end m_offset_extrude ----------
merge_3 = Merge(Data1=simplify(graft(m_fill_2.M)), Data2=m_loft.M, Data3=simplify(graft(m_fill.M)))
volume = MeshVolume(Mesh=m_offset_extrude.A)  # -> Volume, Centroid
mjoin = MeshJoin(Meshes=merge_3)
panel_5 = Panel(mjoin)
