# Grasshopper definition 2023-06-25_Seismic Design Demand Combined - v4.gh (Grasshopper 1.0.7)
# plug-ins: ShapeDiverForGrasshopper, Swiftlet

# ---- group: Risk Category
panel = Panel("III")

# ---- group: Site Class
panel_2 = Panel("D")

# ----
# Enter Address: 505 Sansome St, San Francisco, CA  94111, United States
# Enter Address: 301 howard street, San Francisco, CA
# Enter Address: 121 spear street, san francisco, CA
enter_address = Panel("650 California Street, San Francisco, CA")

sddp = ShapeDiverDocumentPayload({AbsoluteTolerance=0, AngleTolerance=0, DistanceDisplayPrecision=0, GltfVersion="Gltf2", GrasshopperVersion="1.0.0007", InputGroups="{}", OutputGroups="{}", RelativeTolerance=0, RhinoVersion="7.29.23107.3001", UnitSystem=0, VersionCreated="1.14.0.0", VersionSaved="1.14.0.0"})
get_buildings_footprint = BooleanToggle(False)
get_location = BooleanToggle(False)
get_3d_buildings = BooleanToggle(False)
topo_viz = BooleanToggle(False)
panel_3 = Panel("abd1c277b888194d037e760ffb459da4")
radius = ValueList({"200", "300", "400", "500"}, selected="300")
gismo = Gismo_Gismo(gismoFolder="c:\gismo")  # -> readMe; plug-in component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
num = Number(radius)
addresstolocation = Gismo_AddressToLocation(address=enter_address, openweb=get_location)  # -> readMe, location, weblink; inputs openweb: Boolean; plug-in component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
addition = Addition(A=num, B="100")
panel_4 = Panel(addresstolocation.location)

# ---- group: buildings
# 2d shapes
osmobjects = Gismo_OSMObjects({"Building", "Commercial building", "Residential building", "Office building", "Office administrative", "Office government", "Post office", "Hospital", "Ambulance station", "Pharmacy"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}, selected="Building")
osmkeys = Gismo_OSMKeys(OSMobjectName=osmobjects)  # -> readMe, requiredKeys, OSMwebpage; inputs OSMobjectName: list; plug-in component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
osmshapes = Gismo_OSMShapes(
    location=addresstolocation.location,
    radius=num,
    shapeType="0",
    requiredKeys=osmkeys.requiredKeys,
    bakeIt=False,
    runIt=get_buildings_footprint)  # -> readMe, shapes, keys, values, port, titleOriginPt, title; inputs radius: Int32, origin: Point3d, shapeType: Int32, requiredKeys: list, onlyRemove_Ids: tree, bakeIt: Boolean, runIt: Boolean; plug-in component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

# ----
terraingenerator = Gismo_TerrainGenerator(
    location=addresstolocation.location,
    APIkey="abd1c277b888194d037e760ffb459da4",
    radius=addition,
    type="2",
    standThickness="50",
    numOfContours="50",
    bakeIt=False,
    runIt=topo_viz)  # -> readMe, terrain, origin, elevation, elevationContours, title; inputs radius: Int32, source: Int32, type: Int32, origin: Point3d, numOfContours: Int32, legendBakePar: tree, bakeIt: Boolean, runIt: Boolean; plug-in component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
split = TextSplit(Text=panel_4, Separators=",")
panel_5 = Panel(split)
list = ValueList({"S-EBF", "S-EBF (CONN)", "S-SCBF", "S-OCBF", "S-RCSW", "O-RCSW", "S-SMF", "S-IMF", "S-OMF", "S-RCMF", "I-RCMF", "O-RCMF"}, selected="O-RCSW")
tl = Integer("12")
max_plan_dimension_ft = Number("139")
ie = Number(1)
ie_2 = Number("1")
tl_2 = Integer("12")
sfrs = Panel("""S-EBF
S-EBF (CONN)
S-SCBF
S-OCBF
S-RCSW
O-RCSW
S-SMF
S-IMF
S-OMF
S-RCMF
I-RCMF
O-RCMF""")
osm3d = Gismo_OSM3D(shapes=osmshapes.shapes, keys=osmshapes.keys, values=osmshapes.values, treeType=2, bakeIt=False, runIt=get_3d_buildings)  # -> readMe, flatten(threeDeeShapes), threeDeeKeys, threeDeeValues, height; inputs shapes: tree of GeometryBase, keys: list, values: tree, onlyRemove_Ids: tree, treeType: Int32, groundTerrain: Brep, bakeIt: Boolean, runIt: Boolean; plug-in component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

debrep = DeconstructBrep(Brep=osm3d.threeDeeShapes)  # -> Faces, Edges, Vertices
area = Area(Geometry=debrep.Faces)  # -> Area, Centroid
pdecon = Deconstruct(Point=area.Centroid)  # -> XComponent, YComponent, ZComponent
bnd = Bounds(Numbers=pdecon.ZComponent)
dedomain = DeconstructDomain(Domain=bnd)  # -> Start, End
equals = Equality(FirstNumber=pdecon.ZComponent, SecondNumber=dedomain.Start)  # -> Equality, Inequality
dispatch = Dispatch(List=debrep.Faces, DispatchPattern=equals.Equality)  # -> ListA, ListB
pt = ConstructPoint(XCoordinate=0, YCoordinate=0, ZCoordinate=0)
area_2 = Area(Geometry=dispatch.ListA)  # -> Area, Centroid
cp = ClosestPoint(Point=pt, Cloud=flatten(area_2.Centroid))  # -> ClosestPoint, CPIndex, Distance
item = ListItem(List=flatten(osm3d.threeDeeShapes), Index=cp.CPIndex, Wrap=True)

panel_6 = Panel(".3")  # disabled
debrep_2 = DeconstructBrep(Brep=item)  # -> Faces, Edges, Vertices
brep = Brep(terraingenerator.terrain)
contour = Contour(Shape=brep, Point=Point(0, 0, 0), Direction=Vector(0, 0, 1), Distance=panel_6)  # -> flatten(Contours); disabled
area_3 = Area(Geometry=debrep_2.Faces)  # -> Area, Centroid
pdecon_2 = Deconstruct(Point=area_3.Centroid)  # -> XComponent, YComponent, ZComponent

# ---- group: Contour
swatch = ColourSwatch(SwatchColor=RGB(120, 120, 120))  # disabled
preview = CustomPreview(Geometry=contour, Material=swatch)  # disabled

# ----
bnd_2 = Bounds(Numbers=pdecon_2.ZComponent)
dedomain_2 = DeconstructDomain(Domain=bnd_2)  # -> Start, End
equals_2 = Equality(FirstNumber=pdecon_2.ZComponent, SecondNumber=dedomain_2.Start)  # -> Equality, Inequality
equals_3 = Equality(FirstNumber=pdecon_2.ZComponent, SecondNumber=dedomain_2.End)  # -> Equality, Inequality
preview_2 = CustomPreview(Geometry=brep, Material=ColourSwatch(SwatchColor=RGB(196, 196, 196)))
preview_3 = CustomPreview(Geometry=osm3d.threeDeeShapes, Material=ColourSwatch(SwatchColor=RGB(135, 135, 135)))
preview_4 = CustomPreview(Geometry=item, Material=ColourSwatch(SwatchColor=RGB(209, 128, 128)))
dispatch_2 = Dispatch(List=debrep_2.Faces, DispatchPattern=equals_2.Equality)  # -> ListA, ListB
dispatch_3 = Dispatch(List=debrep_2.Faces, DispatchPattern=equals_3.Equality)  # -> ListA, ListB
area_4 = Area(Geometry=dispatch_2.ListA)  # -> Area, Centroid
area_5 = Area(Geometry=dispatch_3.ListA)  # -> Area, Centroid
ln = Line(StartPoint=area_4.Centroid, EndPoint=area_5.Centroid)
len = Length(Curve=ln)
multiplication = Multiplication(A=len, B="3.28084")
round = Round(Number=multiplication)  # -> Nearest, Floor, Ceiling
panel_7 = Panel(round.Nearest)

panel_8 = Panel(panel_7)
height_ft = Number(panel_8)
year_of_building = Number("1994")
sfrs_2 = Text(list)

# ---- group: Applicable Code Year
year_of_building_2 = Number(year_of_building)
codes = Integer([1961, 1964, 1967, 1970, 1973, 1976, 1979, 1982, 1985, 1988, 1991, 1994, 1997, 2005, 2010, 2016, 2022])
smaller = SmallerThan(FirstNumber=year_of_building_2, SecondNumber=codes)  # -> SmallerThan, OrEqualTo
larger = LargerThan(FirstNumber=year_of_building_2, SecondNumber=codes)  # -> LargerThan, OrEqualTo
cull = CullPattern(List=codes, CullPattern=larger.OrEqualTo)
item_2 = ListItem(List=cull, Index="-1", Wrap=True)
panel_9 = Panel(item_2)
index = ItemIndex(List=codes, Item=item_2)

# ----
panel_10 = Panel(codes)
_2016 = Panel("""8
0
6
3.25
6
5
8
4.5
3.5
8
5
3""")

# ---- group: Determine R-Value
_1982 = Panel("""10
0
0
6
0
8
12
0
6
12
7
5""")
_1985 = Panel("""10
0
0
6
0
8
12
0
6
12
7
5""")
_1979 = Panel("""0.8
0
0
0.8
0.67
0.8
0
0.67
0.8
0
0.67
0.8""")
_1991 = Panel("""10
0
0
8
0
8
12
0
6
12
8
5""")
_1988 = Panel("""10
0
0
6
0
8
12
0
6
12
7
5""")
_1997 = Panel("""7
0
0
5.6
0
5.5
8.5
0
4.5
8.5
5.5
3.5""")
_1994 = Panel("""10
0
9
8
0
8
12
0
6
12
8
5""")
_2016_2 = Panel("""8
0
6
3.25
6
5
8
4.5
3.5
8
5
3""")
_2005 = Panel("""8
7
6
3.25
6
5
8
4.5
3.5
8
5
3""")
_2010 = Panel("""8
0
6
3.25
6
5
8
4.5
3.5
8
5
3""")
filter = StreamFilter(
    Gate=index,
    Stream6=_1979,
    Stream7=_1982,
    Stream8=_1985,
    Stream9=_1988,
    Stream10=_1991,
    Stream11=_1994,
    Stream12=_1997,
    Stream13=_2005,
    Stream14=_2010,
    Stream15=_2016_2)
sfrs_3 = Text(sfrs_2)
keysearch = KeyValueSearch(Keys=sfrs, Values=filter, Search=sfrs_3)
panel_11 = Panel(keysearch)

# ----
num_2 = Number(keysearch)

# ---- group: UBC - 1988
x = Panel("""0.75
0.75
0.75
0.75
0.75
0.75
0.75
0.75
0.75
0.75
0.75
0.75""")
ct = Panel("""0.035
0.035
0.035
0.035
0.030
0.020
0.02
0.02
0.02
0.02
0.02
0.02""")
keysearch_2 = KeyValueSearch(Keys=sfrs, Values=ct, Search=sfrs_2)
keysearch_3 = KeyValueSearch(Keys=sfrs, Values=x, Search=sfrs_2)
expression = Expression(ct=keysearch_2, h=height_ft, x=keysearch_3, Expression="ct*(h^x)")
expression_2 = Expression(S="1.5", ta=expression, Expression="1.25*S/(ta^(2/3))")
panel_12 = Panel(expression)
num_3 = Number(num_2)
multiplication_2 = Multiplication(A="0.075", B=num_3)
min = Minimum(A=expression_2, B="2.75")
num_4 = Number("0.4")
max = Maximum(A=min, B=multiplication_2)
num_5 = Number(max)
python = GhPythonScript(Z=num_4, I=ie_2, C=num_5, Rw=num_3)  # -> cs
# ---------- python: Python ----------
"""Provides a scripting component.
    Inputs:
        Z: The Z script variable
        I: The I script variable
        C: The C script variable
        Rw: The Rw script variable
    Output:
        cs: The a output variable"""

__author__ = "ABawiskar"
__version__ = "2023.06.24"

import rhinoscriptsyntax as rs

cs = Z*I*C/Rw
# ---------- end python ----------
panel_13 = Panel(python)

# ---- group: UBC - 1982
expression_3 = Expression(D=max_plan_dimension_ft, h=height_ft, Expression="0.05*h/sqrt(D)")
panel_14 = Panel(expression_3)
expression_4 = Expression(ta=expression_3, Expression="1/(15*sqrt(ta))")
min_2 = Minimum(A=expression_4, B="0.12")
num_6 = Number(num_2)
num_7 = Number("1.5")
num_8 = Number("1")
num_9 = Number(min_2)
python_2 = GhPythonScript(Z=num_8, I=ie_2, C=num_9, K=num_6, S=num_7)  # -> cs
# ---------- python_2: Python ----------
"""Provides a scripting component.
    Inputs:
        Z: The Z script variable
        I: The I script variable
        C: The C script variable
        K: The Rw script variable
    Output:
        cs: The a output variable"""

__author__ = "ABawiskar"
__version__ = "2023.06.24"

import rhinoscriptsyntax as rs

C_S = min(C*S, 0.14)

cs = Z*I*C_S*K
# ---------- end python_2 ----------
panel_15 = Panel(num_9)
panel_16 = Panel(python_2)

# ---- group: UBC - 1994
ct_2 = Panel("""0.03
0.03
0.03
0.03
0.02
0.02
0.035
0.035
0.035
0.03
0.03
0.03""")
keysearch_4 = KeyValueSearch(Keys=sfrs, Values=ct_2, Search=sfrs_2)
num_10 = Number(keysearch_4)
python_3 = GhPythonScript(ie=ie, r=num_2, h=height_ft, ct=num_10)  # -> cs
# ---------- python_3: Python ----------
__author__ = "ABawiskar"
__version__ = "2023.06.24"

import rhinoscriptsyntax as rs
import math

t = ct*(h**0.75)
c=min((1.25*1.2/(t**(2/3))),2.75)
cs = 0.4*ie*c/r
# ---------- end python_3 ----------

# ---- group: UBC - 1997
ct_3 = Panel("""0.03
0.03
0.03
0.03
0.02
0.02
0.035
0.035
0.035
0.03
0.03
0.03""")
keysearch_5 = KeyValueSearch(Keys=sfrs, Values=ct_3, Search=sfrs_2)
num_11 = Number(keysearch_5)
python_4 = GhPythonScript(ie=ie, r=num_2, h=height_ft, ct=num_11)  # -> cs
# ---------- python_4: Python ----------
__author__ = "ABawiskar"
__version__ = "2023.06.24"

import rhinoscriptsyntax as rs
import math

cs_max = 2.5*0.44*(ie/r)
cs_min = 0.8*0.4*(ie/r)

ta = ct*(h**0.75)
cs = 0.64*ie/(r*ta)

cs = min(max(cs_min,cs),cs_max)
# ---------- end python_4 ----------

# ---- group: UBC -1979
num_12 = Number(python_2)

# ---- group: UBC - 1991
num_13 = Number(python_3)

# ----
panel_17 = Panel(python_4)
panel_18 = Panel(python_3)
panel_19 = Panel(num_12)
panel_20 = Panel(num_13)

# ----
# Get Seismic Data with Swiftlet Request
deconstructlocation = Gismo_DeconstructLocation(location=addresstolocation.location)  # -> locationName, latitude, longitude, timeZone, elevation; plug-in component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
cqp = CreateQueryParam(Key="riskCategory", Value=panel)
cqp_2 = CreateQueryParam(Key="siteClass", Value=panel_2)
cqp_3 = CreateQueryParam(Key="title", Value="''")

# ---- group: Latitude
panel_21 = Panel(deconstructlocation.latitude)

# ---- group: Longitude
panel_22 = Panel(deconstructlocation.longitude)

# ----
cqp_4 = CreateQueryParam(Key="latitude", Value=panel_21)
cqp_5 = CreateQueryParam(Key="longitude", Value=panel_22)
merge = Merge(Data1=cqp_4, Data2=cqp_5, Data3=cqp, Data4=cqp_2, Data5=cqp_3)
get = GETRequest(URL="https://earthquake.usgs.gov/ws/designmaps/asce7-16.json", Params=merge)  # -> Status, Content, Response
pjs = ParseJSONString(Text=get.Content)
gjok = GetJSONObjectKey(JObject=pjs, Key="response")
gjok_2 = GetJSONObjectKey(JObject=gjok, Key="data")
gjok_3 = GetJSONObjectKey(JObject=gjok_2, Key="ss")
gjok_4 = GetJSONObjectKey(JObject=gjok_2, Key="s1")
gjok_5 = GetJSONObjectKey(JObject=gjok_2, Key="sms")
gjok_6 = GetJSONObjectKey(JObject=gjok_2, Key="sm1")
gjok_7 = GetJSONObjectKey(JObject=gjok_2, Key="sds")
gjok_8 = GetJSONObjectKey(JObject=gjok_2, Key="sd1")
rjv = ReadJSONValue(JValue=gjok_3)  # -> AsString, AsNumber, AsBool
rjv_2 = ReadJSONValue(JValue=gjok_4)  # -> AsString, AsNumber, AsBool
rjv_3 = ReadJSONValue(JValue=gjok_5)  # -> AsString, AsNumber, AsBool
rjv_4 = ReadJSONValue(JValue=gjok_6)  # -> AsString, AsNumber, AsBool
rjv_5 = ReadJSONValue(JValue=gjok_7)  # -> AsString, AsNumber, AsBool
rjv_6 = ReadJSONValue(JValue=gjok_8)  # -> AsString, AsNumber, AsBool
panel_23 = Panel(rjv.AsString)
panel_24 = Panel(rjv_2.AsString)
panel_25 = Panel(rjv_3.AsString)
panel_26 = Panel(rjv_4.AsString)
panel_27 = Panel(rjv_5.AsString)
panel_28 = Panel(rjv_6.AsString)

null = NullItem(Item=panel_23)  # -> NullFlags, InvalidFlags, Description
null_2 = NullItem(Item=panel_25)  # -> NullFlags, InvalidFlags, Description
null_3 = NullItem(Item=panel_24)  # -> NullFlags, InvalidFlags, Description
null_4 = NullItem(Item=panel_27)  # -> NullFlags, InvalidFlags, Description
filter_2 = StreamFilter(Gate=null.NullFlags, Stream0=panel_23, Stream1="1.5")
filter_3 = StreamFilter(Gate=null_2.NullFlags, Stream0=panel_25, Stream1="1.8")
filter_4 = StreamFilter(Gate=null_3.NullFlags, Stream0=panel_24, Stream1="0.6")
filter_5 = StreamFilter(Gate=null_4.NullFlags, Stream0=panel_27, Stream1="1.2")

# ---- group: Only 1 if its a different value
panel_29 = Panel(panel_28)
sd1 = Number("1")

# ----
panel_30 = Panel(panel_27)
ss = Number(panel_23)
s1 = Number(filter_4)
sms = Number(panel_25)
sds = Number(filter_5)
panel_31 = Panel(s1)
panel_32 = Panel(sd1)
panel_33 = Panel(sds)
sm1 = Number(panel_26)
s1_2 = Number(panel_31)
sds_2 = Number(panel_33)
sd1_2 = Number(panel_32)

# ---- group: ASCE 7-10
x_2 = Panel("""0.8
0.8
0.8
0.8
0.9
0.9
0.75
0.75
0.75
0.75
0.75
0.75""")
ct_4 = Panel("""0.028
0.028
0.028
0.028
0.016
0.016
0.03
0.03
0.03
0.02
0.02
0.02""")
keysearch_6 = KeyValueSearch(Keys=sfrs, Values=ct_4, Search=sfrs_2)
keysearch_7 = KeyValueSearch(Keys=sfrs, Values=x_2, Search=sfrs_2)
expression_5 = Expression(ct=keysearch_6, h=height_ft, x=keysearch_7, Expression="ct*(h^x)")
panel_34 = Panel(expression_5)
python_5 = GhPythonScript(sds=sds_2, r=num_2, ie=ie_2, sd1=sd1_2, tl=tl_2, ta=expression_5, s1=s1_2)  # -> cs
# ---------- python_5: Python ----------
__author__ = "ABawiskar"
__version__ = "2023.06.24"

import rhinoscriptsyntax as rs

if (ta<tl):
    cs_max = sd1/(ta*r/ie)
else:
    cs_max = sd1*tl/((ta^2)(r/ie))

cs_min = max(0.01,0.044*sds*ie)

cs = sds/(r/ie)

if (s1>=0.6):
    cs_min = max(cs_min,0.51*s1/(r/ie))

cs = min(max(cs_min, cs),cs_max)
# ---------- end python_5 ----------
panel_35 = Panel(python_5)

# ---- group: ASCE 7-16
sfrs_4 = Panel(sfrs)
panel_36 = Panel(sfrs_2)
ct_5 = Panel("""0.03
0.03
0.03
0.03
0.02
0.02
0.028
0.028
0.028
0.016
0.016
0.016""")
x_3 = Panel("""0.75
0.75
0.75
0.75
0.75
0.75
0.8
0.8
0.8
0.9
0.9
0.9""")
keysearch_8 = KeyValueSearch(Keys=sfrs_4, Values=x_3, Search=panel_36)
keysearch_9 = KeyValueSearch(Keys=sfrs_4, Values=_2016, Search=panel_36)
keysearch_10 = KeyValueSearch(Keys=sfrs_4, Values=ct_5, Search=panel_36)
num_14 = Number(keysearch_9)
expression_6 = Expression(ct=keysearch_10, h=height_ft, x=keysearch_8, Expression="ct*(h^x)")
python_6 = GhPythonScript(sds=sds, r=num_14, ie=ie, sd1=sd1, tl=tl, ta=expression_6)  # -> cs
# ---------- python_6: Python ----------
__author__ = "ABawiskar"
__version__ = "2023.06.24"

import rhinoscriptsyntax as rs

if (ta<tl):
    cs_max = sd1/(ta*r/ie)
else:
    cs_max = sd1*tl/((ta**2)(r/ie))

cs_min = max(0.01,0.044*sds*ie)

cs = sds/(r/ie)

if (s1>=0.6):
    cs_min = max(cs_min,0.51*s1/(r/ie))

cs = min(max(cs_min, cs),cs_max)
# ---------- end python_6 ----------

# ---- group: ACI 7-05
ct_6 = Panel("""0.028
0.028
0.028
0.028
0.016
0.016
0.03
0.03
0.03
0.02
0.02
0.02""")
x_4 = Panel("""0.8
0.8
0.8
0.8
0.9
0.9
0.75
0.75
0.75
0.75
0.75
0.75""")
keysearch_11 = KeyValueSearch(Keys=sfrs, Values=ct_6, Search=sfrs_2)
keysearch_12 = KeyValueSearch(Keys=sfrs, Values=x_4, Search=sfrs_2)
expression_7 = Expression(ct=keysearch_11, h=height_ft, x=keysearch_12, Expression="ct*(h^x)")
panel_37 = Panel(expression_7)
python_7 = GhPythonScript(sds=sds_2, r=num_2, ie=ie_2, sd1=sd1_2, tl=tl_2, ta=expression_7, s1=s1_2)  # -> cs
# ---------- python_7: Python ----------
__author__ = "ABawiskar"
__version__ = "2023.06.24"

import rhinoscriptsyntax as rs

if (ta<tl):
    cs_max = sd1/(ta*r/ie)
else:
    cs_max = sd1*tl/((ta^2)(r/ie))

cs_min = 0.01

cs = sds/(r/ie)

if (s1>=0.6):
    cs_min = max(cs_min,0.51*s1/(r/ie))

cs = min(max(cs_min, cs),cs_max)
# ---------- end python_7 ----------
panel_38 = Panel(python_7)

# ----
panel_39 = Panel(python_6)
filter_6 = StreamFilter(
    Gate=index,
    Stream6=num_12,
    Stream7=python_2,
    Stream8=_1985,
    Stream9=python,
    Stream10=num_13,
    Stream11=python_3,
    Stream12=python_4,
    Stream13=python_7,
    Stream14=python_5,
    Stream15=python_6)
panel_40 = Panel(python_6)
cs = Number(filter_6)
division = Division(A=panel_40, B="1.4")
year_of_construction = Panel(cs)
asce_7_16 = Panel(division)
expression_8 = Expression(x=asce_7_16, y=year_of_construction, Expression="100*((x-y)/y)")
panel_41 = Panel(expression_8)
