# Grasshopper definition 2023-06-25_Seismic Design Demand Combined - v5.gh (Grasshopper 1.0.7)
# plug-ins: ShapeDiverForGrasshopper, Swiftlet, Wombat

sddp = ShapeDiverDocumentPayload({AbsoluteTolerance=0, AngleTolerance=0, DistanceDisplayPrecision=0, GltfVersion="Gltf2", GrasshopperVersion="1.0.0007", InputGroups="{}", OutputGroups="{}", RelativeTolerance=0, RhinoVersion="7.29.23107.3001", UnitSystem=0, VersionCreated="1.14.0.0", VersionSaved="1.14.0.0"})
panel = Panel("abd1c277b888194d037e760ffb459da4")

# ----
# Enter Address: 650 California Street, San Francisco, CA
# Enter Address: 301 howard street, San Francisco, CA
# Enter Address: 121 spear street, san francisco, CA
enter_address = Panel("505 Sansome St, San Francisco, CA  94111, United States")

gismo = Gismo_Gismo(gismoFolder="c:\gismo")  # -> readMe; plug-in component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
get_location = BooleanToggle(False)
radius = ValueList({"200", "300", "400", "500"}, selected="300")
get_buildings_footprint = BooleanToggle(False)
get_3d_buildings = BooleanToggle(False)
topo_viz = BooleanToggle(False)
num = Number(radius)
addresstolocation = Gismo_AddressToLocation(address=enter_address, openweb=get_location)  # -> readMe, location, weblink; inputs openweb: Boolean; plug-in component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
deconstructlocation = Gismo_DeconstructLocation(location=addresstolocation.location)  # -> locationName, latitude, longitude, timeZone, elevation; plug-in component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

# ---- group: buildings
# 2d shapes
osmobjects = Gismo_OSMObjects({"Building", "Commercial building", "Residential building", "Office building", "Office administrative", "Office government", "Post office", "Hospital", "Ambulance station", "Pharmacy"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}, selected="Building")
osmkeys = Gismo_OSMKeys(OSMobjectName=osmobjects)  # -> readMe, requiredKeys, OSMwebpage; inputs OSMobjectName: list; plug-in component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
osmshapes = Gismo_OSMShapes(
    location=addresstolocation.location,
    radius=num,
    shapeType="0",
    requiredKeys=osmkeys.requiredKeys,
    bakeIt=False,
    runIt=get_buildings_footprint)  # -> readMe, shapes, keys, values, port, titleOriginPt, title; inputs radius: Int32, origin: Point3d, shapeType: Int32, requiredKeys: list, onlyRemove_Ids: tree, bakeIt: Boolean, runIt: Boolean; plug-in component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

# ----
panel_2 = Panel(addresstolocation.location)
panel_3 = Panel(deconstructlocation.locationName)
addition = Addition(A=num, B="100")
terraingenerator = Gismo_TerrainGenerator(
    location=addresstolocation.location,
    APIkey="abd1c277b888194d037e760ffb459da4",
    radius=addition,
    type="2",
    standThickness="50",
    numOfContours="50",
    bakeIt=False,
    runIt=topo_viz)  # -> readMe, terrain, origin, elevation, elevationContours, title; inputs radius: Int32, source: Int32, type: Int32, origin: Point3d, numOfContours: Int32, legendBakePar: tree, bakeIt: Boolean, runIt: Boolean; plug-in component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
osm3d = Gismo_OSM3D(shapes=osmshapes.shapes, keys=osmshapes.keys, values=osmshapes.values, treeType=2, bakeIt=False, runIt=get_3d_buildings)  # -> readMe, flatten(threeDeeShapes), threeDeeKeys, threeDeeValues, height; inputs shapes: tree of GeometryBase, keys: list, values: tree, onlyRemove_Ids: tree, treeType: Int32, groundTerrain: Brep, bakeIt: Boolean, runIt: Boolean; plug-in component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
terrainanalysis = Gismo_TerrainAnalysis(
    analysisType="5",
    terrain=terraingenerator.terrain,
    origin=terraingenerator.origin,
    elevation=terraingenerator.elevation,
    north=0,
    hypsoStrength=50,
    refine=False,
    bakeIt=False,
    runIt=Toggle(False))  # -> readMe, analysedTerrain, values, origin, title, legend, legendPlane; inputs analysisType: Int32, origin: Point3d, context: list, sunVector: Vector3d, refine: Boolean, legendBakePar: tree, bakeIt: Boolean, runIt: Boolean; plug-in component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

panel_4 = Panel("100")  # disabled
Z = UnitZ(Factor=panel_4)  # disabled
move = Move(Geometry=osm3d.threeDeeShapes, Motion=Z)  # -> Geometry, Transform; disabled
clean = CleanTree(RemoveNulls=True, RemoveInvalid=True, RemoveEmpty=True, Tree=move.Geometry)  # disabled
debrep = DeconstructBrep(Brep=clean)  # -> Faces, Edges, simplify(Vertices); disabled
pdecon = Deconstruct(Point=debrep.Vertices)  # -> XComponent, YComponent, ZComponent; disabled
bnd = Bounds(Numbers=pdecon.ZComponent)  # disabled
dedomain = DeconstructDomain(Domain=bnd)  # -> Start, End; disabled
equals = Equality(FirstNumber=pdecon.ZComponent, SecondNumber=dedomain.Start)  # -> Equality, Inequality; disabled
dispatch = Dispatch(List=debrep.Vertices, DispatchPattern=equals.Equality)  # -> ListA, ListB; disabled
item = ListItem(List=dispatch.ListA, Index=0, Wrap=True)  # disabled
project = ProjectPoint(Point=item, Direction=Vector(0, 0, -1), Geometry=terrainanalysis.analysedTerrain)  # -> Point, Index; disabled
pdecon_2 = Deconstruct(Point=project.Point)  # -> XComponent, YComponent, ZComponent; disabled
bnd_2 = Bounds(Numbers=pdecon_2.ZComponent)  # disabled
dedomain_2 = DeconstructDomain(Domain=bnd_2)  # -> Start, End; disabled
equals_2 = Equality(FirstNumber=pdecon_2.ZComponent, SecondNumber=dedomain_2.Start)  # -> Equality, Inequality; disabled
dispatch_2 = Dispatch(List=project.Point, DispatchPattern=equals_2.Equality)  # -> ListA, ListB; disabled
ln = Line(StartPoint=item, EndPoint=dispatch_2.ListA)  # disabled
len = Length(Curve=ln)  # disabled
Z_2 = UnitZ(Factor=expr("x*-1", len))  # disabled
move_2 = Move(Geometry=clean, Motion=Z_2)  # -> Geometry, Transform; disabled

debrep_2 = DeconstructBrep(Brep=osm3d.threeDeeShapes)  # -> Faces, Edges, Vertices
area = Area(Geometry=debrep_2.Faces)  # -> Area, Centroid
pdecon_3 = Deconstruct(Point=area.Centroid)  # -> XComponent, YComponent, ZComponent
bnd_3 = Bounds(Numbers=pdecon_3.ZComponent)
dedomain_3 = DeconstructDomain(Domain=bnd_3)  # -> Start, End
equals_3 = Equality(FirstNumber=pdecon_3.ZComponent, SecondNumber=dedomain_3.Start)  # -> Equality, Inequality
equals_4 = Equality(FirstNumber=pdecon_3.ZComponent, SecondNumber=dedomain_3.End)  # -> Equality, Inequality
dispatch_3 = Dispatch(List=debrep_2.Faces, DispatchPattern=equals_3.Equality)  # -> ListA, ListB
dispatch_4 = Dispatch(List=debrep_2.Faces, DispatchPattern=equals_4.Equality)  # -> ListA, ListB
pt = ConstructPoint(XCoordinate=0, YCoordinate=0, ZCoordinate=0)
area_2 = Area(Geometry=dispatch_3.ListA)  # -> Area, Centroid
Z_3 = UnitZ(Factor="28")
cp = ClosestPoint(Point=pt, Cloud=flatten(area_2.Centroid))  # -> ClosestPoint, CPIndex, Distance
item_2 = ListItem(List=flatten(dispatch_4.ListA), Index=cp.CPIndex, Wrap=True)
area_3 = Area(Geometry=item_2)  # -> Area, Centroid
move_3 = Move(Geometry=area_3.Centroid, Motion=Z_3)  # -> Geometry, Transform

cull_i = CullIndex(List=osm3d.threeDeeShapes, Indices=cp.CPIndex, Wrap=True)
panel_5 = Panel(".3")  # disabled
brep = Brep(terraingenerator.terrain)
contour = Contour(Shape=brep, Point=Point(0, 0, 0), Direction=Vector(0, 0, 1), Distance=panel_5)  # -> flatten(Contours); disabled

# ---- group: Risk Category
panel_6 = Panel("III")

# ---- group: Site Class
panel_7 = Panel("D")

# ---- group: List Main LocationPoint
pt_2 = Point(Point(1347.32729, 1075.674384, -99.59346126))

# ----
sfrs = Panel("""S-EBF
S-EBF (CONN)
S-SCBF
S-OCBF
S-RCSW
O-RCSW
S-SMF
S-IMF
S-OMF
S-RCMF
I-RCMF
O-RCMF""")
tl = Integer("12")
max_plan_dimension_ft = Number("139")
ie = Number("1")
tl_2 = Integer("12")
ie_2 = Number(1)

# ---- group: Contour
swatch = ColourSwatch(SwatchColor=RGB(120, 120, 120))  # disabled
preview = CustomPreview(Geometry=contour, Material=swatch)  # disabled

# ----
# Get Seismic Data with Swiftlet Request
deconstructlocation_2 = Gismo_DeconstructLocation(location=addresstolocation.location)  # -> locationName, latitude, longitude, timeZone, elevation; plug-in component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
cqp = CreateQueryParam(Key="riskCategory", Value=panel_6)
cqp_2 = CreateQueryParam(Key="siteClass", Value=panel_7)
cqp_3 = CreateQueryParam(Key="title", Value="''")

# ---- group: Latitude
panel_8 = Panel(deconstructlocation_2.latitude)

# ---- group: Longitude
panel_9 = Panel(deconstructlocation_2.longitude)

# ----
cqp_4 = CreateQueryParam(Key="latitude", Value=panel_8)
cqp_5 = CreateQueryParam(Key="longitude", Value=panel_9)
merge = Merge(Data1=cqp_4, Data2=cqp_5, Data3=cqp, Data4=cqp_2, Data5=cqp_3)
get = GETRequest(URL="https://earthquake.usgs.gov/ws/designmaps/asce7-16.json", Params=merge)  # -> Status, Content, Response
pjs = ParseJSONString(Text=get.Content)
gjok = GetJSONObjectKey(JObject=pjs, Key="response")
gjok_2 = GetJSONObjectKey(JObject=gjok, Key="data")
gjok_3 = GetJSONObjectKey(JObject=gjok_2, Key="ss")
gjok_4 = GetJSONObjectKey(JObject=gjok_2, Key="s1")
gjok_5 = GetJSONObjectKey(JObject=gjok_2, Key="sms")
gjok_6 = GetJSONObjectKey(JObject=gjok_2, Key="sm1")
gjok_7 = GetJSONObjectKey(JObject=gjok_2, Key="sds")
gjok_8 = GetJSONObjectKey(JObject=gjok_2, Key="sd1")
rjv = ReadJSONValue(JValue=gjok_3)  # -> AsString, AsNumber, AsBool
rjv_2 = ReadJSONValue(JValue=gjok_4)  # -> AsString, AsNumber, AsBool
rjv_3 = ReadJSONValue(JValue=gjok_5)  # -> AsString, AsNumber, AsBool
rjv_4 = ReadJSONValue(JValue=gjok_6)  # -> AsString, AsNumber, AsBool
rjv_5 = ReadJSONValue(JValue=gjok_7)  # -> AsString, AsNumber, AsBool
rjv_6 = ReadJSONValue(JValue=gjok_8)  # -> AsString, AsNumber, AsBool
panel_10 = Panel(rjv.AsString)
panel_11 = Panel(rjv_2.AsString)
panel_12 = Panel(rjv_5.AsString)
panel_13 = Panel(rjv_3.AsString)
panel_14 = Panel(rjv_4.AsString)
panel_15 = Panel(rjv_6.AsString)

null = NullItem(Item=panel_10)  # -> NullFlags, InvalidFlags, Description
null_2 = NullItem(Item=panel_13)  # -> NullFlags, InvalidFlags, Description
null_3 = NullItem(Item=panel_11)  # -> NullFlags, InvalidFlags, Description
null_4 = NullItem(Item=panel_12)  # -> NullFlags, InvalidFlags, Description
sm1 = Number(panel_14)
filter = StreamFilter(Gate=null.NullFlags, Stream0=panel_10, Stream1="1.5")
filter_2 = StreamFilter(Gate=null_2.NullFlags, Stream0=panel_13, Stream1="1.8")
filter_3 = StreamFilter(Gate=null_3.NullFlags, Stream0=panel_11, Stream1="0.6")
filter_4 = StreamFilter(Gate=null_4.NullFlags, Stream0=panel_12, Stream1="1.2")

# ---- group: Only 1 if its a different value
panel_16 = Panel(panel_15)
sd1 = Number("1")

# ----
panel_17 = Panel(panel_12)
ss = Number(panel_10)
s1 = Number(filter_3)
sms = Number(panel_13)
sds = Number(filter_4)
panel_18 = Panel(s1)
panel_19 = Panel(sd1)
panel_20 = Panel(sds)
s1_2 = Number(panel_18)
sds_2 = Number(panel_20)
sd1_2 = Number(panel_19)

merge_2 = Merge(
    Data1="Building Location",
    Data2=" ",
    Data3="Year of Construction",
    Data4=" ",
    Data5="SFRS",
    Data6=" ",
    Data7="Cs Original",
    Data8=" ",
    Data9="Cs ASCE 7-16",
    Data10=" ",
    Data11="% Difference",
    Data12=" ")
txt = Text(graft(merge_2))
number_slider = Slider(30, range=0..30)
toggle = BooleanToggle(True)
multiplication = Multiplication(A=number_slider, B=Slider(2, range=0..10))
division = Division(A=multiplication, B=".8")
multiplication_2 = Multiplication(A=number_slider, B=".8")
pt_3 = ConstructPoint(XCoordinate="0", YCoordinate=0, ZCoordinate="0")
X = UnitX(Factor="-3")
move_4 = Move(Geometry=pt_2, Motion=X)  # -> Geometry, Transform
addition_2 = Addition(A="-3", B=multiplication_2)
X_2 = UnitX(Factor=addition_2)
move_5 = Move(Geometry=pt_2, Motion=X_2)  # -> Geometry, Transform
vec = VectorXYZ(XComponent="0", YComponent=expr("x*-1", division), ZComponent="0")  # -> Vector, Length
toggle_2 = BooleanToggle(True)
toggle_3 = BooleanToggle(True)
path = DataPath("11")

list = ValueList({"S-EBF", "S-EBF (CONN)", "S-SCBF", "S-OCBF", "S-RCSW", "O-RCSW", "S-SMF", "S-IMF", "S-OMF", "S-RCMF", "I-RCMF", "O-RCMF"}, selected="O-RCSW")
sfrs_2 = Text(list)
year_of_building = Number("1994")

# ---- group: Applicable Code Year
year_of_building_2 = Number(year_of_building)
codes = Integer([1961, 1964, 1967, 1970, 1973, 1976, 1979, 1982, 1985, 1988, 1991, 1994, 1997, 2005, 2010, 2016, 2022])
smaller = SmallerThan(FirstNumber=year_of_building_2, SecondNumber=codes)  # -> SmallerThan, OrEqualTo
larger = LargerThan(FirstNumber=year_of_building_2, SecondNumber=codes)  # -> LargerThan, OrEqualTo
panel_21 = Panel(codes)
cull = CullPattern(List=codes, CullPattern=larger.OrEqualTo)
item_3 = ListItem(List=cull, Index="-1", Wrap=True)
panel_22 = Panel(item_3)
index = ItemIndex(List=codes, Item=item_3)

# ---- group: Determine R-Value
_1982 = Panel("""10
0
0
6
0
8
12
0
6
12
7
5""")
_1985 = Panel("""10
0
0
6
0
8
12
0
6
12
7
5""")
_1979 = Panel("""0.8
0
0
0.8
0.67
0.8
0
0.67
0.8
0
0.67
0.8""")
_1991 = Panel("""10
0
0
8
0
8
12
0
6
12
8
5""")
_1988 = Panel("""10
0
0
6
0
8
12
0
6
12
7
5""")
_1997 = Panel("""7
0
0
5.6
0
5.5
8.5
0
4.5
8.5
5.5
3.5""")
_1994 = Panel("""10
0
9
8
0
8
12
0
6
12
8
5""")
_2016 = Panel("""8
0
6
3.25
6
5
8
4.5
3.5
8
5
3""")
_2005 = Panel("""8
7
6
3.25
6
5
8
4.5
3.5
8
5
3""")
_2010 = Panel("""8
0
6
3.25
6
5
8
4.5
3.5
8
5
3""")
filter_5 = StreamFilter(
    Gate=index,
    Stream6=_1979,
    Stream7=_1982,
    Stream8=_1985,
    Stream9=_1988,
    Stream10=_1991,
    Stream11=_1994,
    Stream12=_1997,
    Stream13=_2005,
    Stream14=_2010,
    Stream15=_2016)
sfrs_3 = Text(sfrs_2)
keysearch = KeyValueSearch(Keys=sfrs, Values=filter_5, Search=sfrs_3)
panel_23 = Panel(keysearch)

# ----
num_2 = Number(keysearch)

# ---- group: ASCE 7-10
x = Panel("""0.8
0.8
0.8
0.8
0.9
0.9
0.75
0.75
0.75
0.75
0.75
0.75""")
ct = Panel("""0.028
0.028
0.028
0.028
0.016
0.016
0.03
0.03
0.03
0.02
0.02
0.02""")
keysearch_2 = KeyValueSearch(Keys=sfrs, Values=ct, Search=sfrs_2)
keysearch_3 = KeyValueSearch(Keys=sfrs, Values=x, Search=sfrs_2)

# ---- group: ACI 7-05
ct_2 = Panel("""0.028
0.028
0.028
0.028
0.016
0.016
0.03
0.03
0.03
0.02
0.02
0.02""")
x_2 = Panel("""0.8
0.8
0.8
0.8
0.9
0.9
0.75
0.75
0.75
0.75
0.75
0.75""")
keysearch_4 = KeyValueSearch(Keys=sfrs, Values=ct_2, Search=sfrs_2)
keysearch_5 = KeyValueSearch(Keys=sfrs, Values=x_2, Search=sfrs_2)

# ---- group: ASCE 7-16
sfrs_4 = Panel(sfrs)
panel_24 = Panel(sfrs_2)
_2016_2 = Panel("""8
0
6
3.25
6
5
8
4.5
3.5
8
5
3""")
ct_3 = Panel("""0.03
0.03
0.03
0.03
0.02
0.02
0.028
0.028
0.028
0.016
0.016
0.016""")
x_3 = Panel("""0.75
0.75
0.75
0.75
0.75
0.75
0.8
0.8
0.8
0.9
0.9
0.9""")
keysearch_6 = KeyValueSearch(Keys=sfrs_4, Values=x_3, Search=panel_24)
keysearch_7 = KeyValueSearch(Keys=sfrs_4, Values=_2016_2, Search=panel_24)
keysearch_8 = KeyValueSearch(Keys=sfrs_4, Values=ct_3, Search=panel_24)
num_3 = Number(keysearch_7)

# ---- group: UBC - 1988
x_4 = Panel("""0.75
0.75
0.75
0.75
0.75
0.75
0.75
0.75
0.75
0.75
0.75
0.75""")
ct_4 = Panel("""0.035
0.035
0.035
0.035
0.030
0.020
0.02
0.02
0.02
0.02
0.02
0.02""")
keysearch_9 = KeyValueSearch(Keys=sfrs, Values=ct_4, Search=sfrs_2)
keysearch_10 = KeyValueSearch(Keys=sfrs, Values=x_4, Search=sfrs_2)
num_4 = Number(num_2)
multiplication_3 = Multiplication(A="0.075", B=num_4)
num_5 = Number("0.4")

# ---- group: UBC - 1997
ct_5 = Panel("""0.03
0.03
0.03
0.03
0.02
0.02
0.035
0.035
0.035
0.03
0.03
0.03""")
keysearch_11 = KeyValueSearch(Keys=sfrs, Values=ct_5, Search=sfrs_2)
num_6 = Number(keysearch_11)

# ---- group: UBC - 1994
ct_6 = Panel("""0.03
0.03
0.03
0.03
0.02
0.02
0.035
0.035
0.035
0.03
0.03
0.03""")
keysearch_12 = KeyValueSearch(Keys=sfrs, Values=ct_6, Search=sfrs_2)
num_7 = Number(keysearch_12)

# ---- group: UBC - 1982
num_8 = Number(num_2)
num_9 = Number("1.5")
num_10 = Number("1")

# ----
swatch_2 = ColourSwatch(SwatchColor=RGB(209, 128, 128))
item_4 = ListItem(List=flatten(osm3d.threeDeeShapes), Index=cp.CPIndex, Wrap=True)
preview_2 = CustomPreview(Geometry=cull_i, Material=ColourSwatch(SwatchColor=RGB(135, 135, 135)))
preview_3 = CustomPreview(Geometry=item_4, Material=swatch_2)
preview_4 = CustomPreview(Geometry=brep, Material=ColourSwatch(SwatchColor=RGB(196, 196, 196)))

debrep_3 = DeconstructBrep(Brep=item_4)  # -> Faces, Edges, Vertices
area_4 = Area(Geometry=debrep_3.Faces)  # -> Area, Centroid
pdecon_4 = Deconstruct(Point=area_4.Centroid)  # -> XComponent, YComponent, ZComponent
bnd_4 = Bounds(Numbers=pdecon_4.ZComponent)
dedomain_4 = DeconstructDomain(Domain=bnd_4)  # -> Start, End
equals_5 = Equality(FirstNumber=pdecon_4.ZComponent, SecondNumber=dedomain_4.Start)  # -> Equality, Inequality
equals_6 = Equality(FirstNumber=pdecon_4.ZComponent, SecondNumber=dedomain_4.End)  # -> Equality, Inequality
dispatch_5 = Dispatch(List=debrep_3.Faces, DispatchPattern=equals_5.Equality)  # -> ListA, ListB
dispatch_6 = Dispatch(List=debrep_3.Faces, DispatchPattern=equals_6.Equality)  # -> ListA, ListB
area_5 = Area(Geometry=dispatch_5.ListA)  # -> Area, Centroid
area_6 = Area(Geometry=dispatch_6.ListA)  # -> Area, Centroid
ln_2 = Line(StartPoint=area_5.Centroid, EndPoint=area_6.Centroid)
len_2 = Length(Curve=ln_2)
multiplication_4 = Multiplication(A=len_2, B="3.28084")
round = Round(Number=multiplication_4)  # -> Nearest, Floor, Ceiling

panel_25 = Panel(round.Nearest)
panel_26 = Panel(panel_25)
height_ft = Number(panel_26)

# ---- group: ASCE 7-10 (continued)
expression = Expression(ct=keysearch_2, h=height_ft, x=keysearch_3, Expression="ct*(h^x)")
panel_27 = Panel(expression)
python = GhPythonScript(sds=sds_2, r=num_2, ie=ie, sd1=sd1_2, tl=tl_2, ta=expression, s1=s1_2)  # -> cs
# ---------- python: Python ----------
__author__ = "ABawiskar"
__version__ = "2023.06.24"

import rhinoscriptsyntax as rs

if (ta<tl):
    cs_max = sd1/(ta*r/ie)
else:
    cs_max = sd1*tl/((ta^2)(r/ie))

cs_min = max(0.01,0.044*sds*ie)

cs = sds/(r/ie)

if (s1>=0.6):
    cs_min = max(cs_min,0.51*s1/(r/ie))

cs = min(max(cs_min, cs),cs_max)
# ---------- end python ----------
panel_28 = Panel(python)

# ---- group: ACI 7-05 (continued)
expression_2 = Expression(ct=keysearch_4, h=height_ft, x=keysearch_5, Expression="ct*(h^x)")
panel_29 = Panel(expression_2)
python_2 = GhPythonScript(sds=sds_2, r=num_2, ie=ie, sd1=sd1_2, tl=tl_2, ta=expression_2, s1=s1_2)  # -> cs
# ---------- python_2: Python ----------
__author__ = "ABawiskar"
__version__ = "2023.06.24"

import rhinoscriptsyntax as rs

if (ta<tl):
    cs_max = sd1/(ta*r/ie)
else:
    cs_max = sd1*tl/((ta^2)(r/ie))

cs_min = 0.01

cs = sds/(r/ie)

if (s1>=0.6):
    cs_min = max(cs_min,0.51*s1/(r/ie))

cs = min(max(cs_min, cs),cs_max)
# ---------- end python_2 ----------
panel_30 = Panel(python_2)

# ---- group: ASCE 7-16 (continued)
expression_3 = Expression(ct=keysearch_8, h=height_ft, x=keysearch_6, Expression="ct*(h^x)")
python_3 = GhPythonScript(sds=sds, r=num_3, ie=ie_2, sd1=sd1, tl=tl, ta=expression_3)  # -> cs
# ---------- python_3: Python ----------
__author__ = "ABawiskar"
__version__ = "2023.06.24"

import rhinoscriptsyntax as rs

if (ta<tl):
    cs_max = sd1/(ta*r/ie)
else:
    cs_max = sd1*tl/((ta**2)(r/ie))

cs_min = max(0.01,0.044*sds*ie)

cs = sds/(r/ie)

if (s1>=0.6):
    cs_min = max(cs_min,0.51*s1/(r/ie))

cs = min(max(cs_min, cs),cs_max)
# ---------- end python_3 ----------
panel_31 = Panel(python_3)

# ---- group: UBC - 1988 (continued)
expression_4 = Expression(ct=keysearch_9, h=height_ft, x=keysearch_10, Expression="ct*(h^x)")
expression_5 = Expression(S="1.5", ta=expression_4, Expression="1.25*S/(ta^(2/3))")
panel_32 = Panel(expression_4)
min = Minimum(A=expression_5, B="2.75")
max = Maximum(A=min, B=multiplication_3)
num_11 = Number(max)
python_4 = GhPythonScript(Z=num_5, I=ie, C=num_11, Rw=num_4)  # -> cs
# ---------- python_4: Python ----------
"""Provides a scripting component.
    Inputs:
        Z: The Z script variable
        I: The I script variable
        C: The C script variable
        Rw: The Rw script variable
    Output:
        cs: The a output variable"""

__author__ = "ABawiskar"
__version__ = "2023.06.24"

import rhinoscriptsyntax as rs

cs = Z*I*C/Rw
# ---------- end python_4 ----------
panel_33 = Panel(python_4)

# ---- group: UBC - 1997 (continued)
python_5 = GhPythonScript(ie=ie_2, r=num_2, h=height_ft, ct=num_6)  # -> cs
# ---------- python_5: Python ----------
__author__ = "ABawiskar"
__version__ = "2023.06.24"

import rhinoscriptsyntax as rs
import math

cs_max = 2.5*0.44*(ie/r)
cs_min = 0.8*0.4*(ie/r)

ta = ct*(h**0.75)
cs = 0.64*ie/(r*ta)

cs = min(max(cs_min,cs),cs_max)
# ---------- end python_5 ----------
panel_34 = Panel(python_5)

# ----
panel_35 = Panel(python_3)
division_2 = Division(A=panel_35, B="1.4")
asce_7_16 = Panel(division_2)

# ---- group: UBC - 1982 (continued)
expression_6 = Expression(D=max_plan_dimension_ft, h=height_ft, Expression="0.05*h/sqrt(D)")
panel_36 = Panel(expression_6)
expression_7 = Expression(ta=expression_6, Expression="1/(15*sqrt(ta))")
min_2 = Minimum(A=expression_7, B="0.12")
num_12 = Number(min_2)
python_6 = GhPythonScript(Z=num_10, I=ie, C=num_12, K=num_8, S=num_9)  # -> cs
# ---------- python_6: Python ----------
"""Provides a scripting component.
    Inputs:
        Z: The Z script variable
        I: The I script variable
        C: The C script variable
        K: The Rw script variable
    Output:
        cs: The a output variable"""

__author__ = "ABawiskar"
__version__ = "2023.06.24"

import rhinoscriptsyntax as rs

C_S = min(C*S, 0.14)

cs = Z*I*C_S*K
# ---------- end python_6 ----------
panel_37 = Panel(num_12)
panel_38 = Panel(python_6)

# ---- group: UBC - 1982 / UBC -1979
num_13 = Number(python_6)

# ---- group: UBC - 1982 (continued)
panel_39 = Panel(num_13)

# ---- group: UBC - 1994 (continued)
python_7 = GhPythonScript(ie=ie_2, r=num_2, h=height_ft, ct=num_7)  # -> cs
# ---------- python_7: Python ----------
__author__ = "ABawiskar"
__version__ = "2023.06.24"

import rhinoscriptsyntax as rs
import math

t = ct*(h**0.75)
c=min((1.25*1.2/(t**(2/3))),2.75)
cs = 0.4*ie*c/r
# ---------- end python_7 ----------
panel_40 = Panel(python_7)

# ---- group: UBC - 1994 / UBC - 1991
num_14 = Number(python_7)

# ---- group: UBC - 1994 (continued)
panel_41 = Panel(num_14)

# ----
filter_6 = StreamFilter(
    Gate=index,
    Stream6=num_13,
    Stream7=python_6,
    Stream8=_1985,
    Stream9=python_4,
    Stream10=num_14,
    Stream11=python_7,
    Stream12=python_5,
    Stream13=python_2,
    Stream14=python,
    Stream15=python_3)
cs = Number(filter_6)
year_of_construction = Panel(cs)
expression_8 = Expression(x=asce_7_16, y=year_of_construction, Expression="100*((x-y)/y)")
panel_42 = Panel(expression_8)
round_2 = Round(Number=panel_42)  # -> Nearest, Floor, Ceiling

merge_3 = Merge(
    Data1=" ",
    Data2=flatten(deconstructlocation.locationName),
    Data3=" ",
    Data4=flatten(year_of_building),
    Data5=" ",
    Data6=flatten(sfrs_2),
    Data7=" ",
    Data8=flatten(year_of_construction),
    Data9=" ",
    Data10=flatten(asce_7_16),
    Data11=" ",
    Data12=flatten(round_2.Nearest))
txt_2 = Text(simplify(merge_3))
panel_43 = Panel(txt_2)
lng = ListLength(List=flatten(txt_2))
arrlinear = LinearArray(Geometry=move_4.Geometry, Direction=vec.Vector, Count=lng)  # -> graft(Geometry), Transform
arrlinear_2 = LinearArray(Geometry=move_5.Geometry, Direction=vec.Vector, Count=lng)  # -> graft(Geometry), Transform
text2crv = TextOutlines(TextContent=graft(txt), Plane=arrlinear.Geometry, Face="Arial", Size=number_slider, Bold=toggle, Italics=True)  # -> TextCurves, TextBoundingBox
text2crv_2 = TextOutlines(TextContent=graft(txt_2), Plane=arrlinear_2.Geometry, Face="Arial", Size=multiplication_2, Bold=toggle, Italics=True)  # -> TextCurves, TextBoundingBox
clean_2 = CleanTree(RemoveNulls=toggle_2, RemoveInvalid=toggle_2, RemoveEmpty=toggle_2, Tree=text2crv.TextCurves)
clean_3 = CleanTree(RemoveNulls=toggle_3, RemoveInvalid=toggle_3, RemoveEmpty=toggle_3, Tree=text2crv_2.TextCurves)
boundary = BoundarySurfaces(Edges=clean_2)
boundary_2 = BoundarySurfaces(Edges=clean_3)  # -> simplify(Surfaces)
branch = TreeBranch(Tree=boundary_2, Path="11", MaintainPaths=True)
area_7 = Area(Geometry=branch)  # -> Area, Centroid
split = SplitTree(Data=boundary_2, Masks=flatten(path))  # -> Positive, Negative
avr = Average(Input=area_7.Centroid)
mesh = MeshBrep(
    Brep=flatten(split.Negative),
    Settings={GridMaxCount=0, GridMinCount=16, JaggedSeams=False, MaxEdgeLength=0, MinEdgeLength=0.0001, MinTolerance=0, Refine=True, RefineAngle=0, RelativeTolerance=0.65, SimplePlanes=True, Tolerance=0})
mesh_2 = MeshBrep(
    Brep=flatten(boundary),
    Settings={GridMaxCount=0, GridMinCount=16, JaggedSeams=False, MaxEdgeLength=0, MinEdgeLength=0.0001, MinTolerance=0, Refine=True, RefineAngle=0, RelativeTolerance=0.65, SimplePlanes=True, Tolerance=0})
scale = Scale(Geometry=branch, Center=avr, Factor="1.5")  # -> flatten(Geometry), Transform

tag = TextTag(Location=move_3.Geometry, Text=asce_7_16, Colour=ColourSwatch(SwatchColor=RGB(0, 0, 0)))
preview_5 = CustomPreview(Geometry=scale.Geometry, Material=swatch_2)
preview_6 = CustomPreview(Geometry=mesh_2, Material=ColourSwatch(SwatchColor=RGB(0, 0, 0)))
preview_7 = CustomPreview(Geometry=mesh, Material=ColourSwatch(SwatchColor=RGB(92, 92, 92)))
