# Grasshopper definition SesimicDataScraping.gh (Grasshopper 1.0.7)
# plug-ins: Swiftlet, CORE.Toolbox.Grasshopper

# ----
# Get Building Lat/Long Centroids
panel = Panel("C:\Users\sxmoore\Downloads\Tall_building_Inventory")
xl_in = ReadFromExcel(WorkbookFilepath=panel, Live=False, Stream=Toggle(True))
tstat = TreeStatistics(Tree=xl_in)  # -> Paths, Length, Count
cull_i = CullIndex(List=tstat.Paths, Indices="0", Wrap=True)
branch = TreeBranch(Tree=xl_in, Path=graft(cull_i), MaintainPaths=True)
item = ListItem(List=branch, Index="1", Wrap=True)
split = TextSplit(Text=item, Separators="((")
item_2 = ListItem(List=split, Index="2", Wrap=True)
split_2 = TextSplit(Text=item_2, Separators="))")
item_3 = ListItem(List=split_2, Index="0", Wrap=True)
split_3 = TextSplit(Text=item_3, Separators=",")
split_4 = TextSplit(Text=split_3, Separators=" ")
item_4 = ListItem(List=split_4, Index="-2", Wrap=True)
item_5 = ListItem(List=split_4, Index="-1", Wrap=True)
trim = TrimTree(Tree=item_4, Depth=1)
trim_2 = TrimTree(Tree=item_5, Depth=1)
pt = ConstructPoint(XCoordinate=trim, YCoordinate=trim_2, ZCoordinate=0)
pline = PolyLine(Vertices=pt, Closed=False)
area = Area(Geometry=pline)  # -> Area, Centroid

panel_2 = Panel(xl_in)

# ---- group: animate sliders
c_script = CSharpScript(reset=Button(), run=Button(), SliderNames="animate")  # -> out, A; inputs reset: Boolean, run: Boolean, SliderNames: list of String, Runs: Int32
# ---------- c_script: C# usings ----------
using Grasshopper.Kernel.Special;
using Grasshopper.Kernel.Parameters;
# ---------- c_script: C# ----------
    if (!run)
    {
      gH_Document = Component.OnPingDocument();
      _SliderNames = SliderNames;
      _sliders = FindSlidersByName();

    }

    if (run)
      GrasshopperDocument.ScheduleSolution(10, ScheduleCallback);

    if (reset) resetSliders(_sliders);
# ---------- c_script: C# additional code ----------
  private GH_NumberSlider[] _sliders;
  GH_Document gH_Document;
  List<string> _SliderNames;

  private void ScheduleCallback(GH_Document document)
  {
    foreach (var slider in _sliders){
      decimal max = slider.Slider.Maximum;
      decimal current = slider.Slider.Value;
      decimal places = slider.Slider.DecimalPlaces;
      decimal iterator = (decimal) (1 / (Math.Pow(10, (int) places)));

      for (decimal k = current; k <= max; k += iterator)
        slider.TrySetSliderValue((decimal) k);
    }

  }

  private void resetSliders(GH_NumberSlider[] _sliders){

    foreach (var slider in _sliders){
      slider.TrySetSliderValue((decimal) 0);

    }
  }


  private GH_NumberSlider[] FindSlidersByName()
  {

    var sliders = new List<GH_NumberSlider>();

    foreach(var NickName in _SliderNames)
      foreach (var obj in gH_Document.Objects)
      {
        if(obj.NickName == NickName){
          var slider = obj as GH_NumberSlider;
          if (slider != null)
            sliders.Add(slider);
        }

      }
    return sliders.ToArray();
  }


  private GH_NumberSlider[] FindSliders()
  {

    var sliders = new List<GH_NumberSlider>();

    foreach (var obj in gH_Document.Objects)
    {
      if(_SliderNames.Contains(obj.NickName)){
        var slider = obj as GH_NumberSlider;
        if (slider != null)
          sliders.Add(slider);
      }

    }
    return sliders.ToArray();
  }
# ---------- end c_script ----------
panel_4 = Panel(c_script.A)

# ----
animate = Slider(0, range=0..179)
tstat_2 = TreeStatistics(Tree=branch)  # -> Paths, Length, Count
flatten = FlattenTree(Tree=area.Centroid, Path="{0}")
item_6 = ListItem(List=flatten, Index=animate, Wrap=True)
item_7 = ListItem(List=tstat_2.Paths, Index=animate, Wrap=True)
branch_2 = TreeBranch(Tree=branch, Path=item_7, MaintainPaths=True)
pdecon = Deconstruct(Point=item_6)  # -> XComponent, YComponent, ZComponent
item_8 = ListItem(List=branch_2, Index="3", Wrap=True)
item_9 = ListItem(List=branch_2, Index="9", Wrap=True)
item_10 = ListItem(List=branch_2, Index="6", Wrap=True)
item_11 = ListItem(List=branch_2, Index="12", Wrap=True)
item_12 = ListItem(List=branch_2, Index="15", Wrap=True)

# ---- group: Latitude
# Get Seismic Data with Swiftlet Request
panel_5 = Panel(pdecon.YComponent)

# ---- group: Longitude
panel_6 = Panel(pdecon.XComponent)

# ---- group: Risk Category
panel_7 = Panel("III")

# ---- group: Site Class
panel_8 = Panel("D")

# ----
rep = ReplaceText(Text=item_11, Find=",", Replace=" ", RecursiveReplace=False)

cqp = CreateQueryParam(Key="latitude", Value=panel_5)
cqp_2 = CreateQueryParam(Key="longitude", Value=panel_6)
cqp_3 = CreateQueryParam(Key="riskCategory", Value=panel_7)
cqp_4 = CreateQueryParam(Key="siteClass", Value=panel_8)
cqp_5 = CreateQueryParam(Key="title", Value="''")
merge = Merge(Data1=cqp, Data2=cqp_2, Data3=cqp_3, Data4=cqp_4, Data5=cqp_5)
get = GETRequest(URL="https://earthquake.usgs.gov/ws/designmaps/asce7-16.json", Params=merge)  # -> Status, Content, Response
pjs = ParseJSONString(Text=get.Content)
gjok = GetJSONObjectKey(JObject=pjs, Key="response")
gjok_2 = GetJSONObjectKey(JObject=gjok, Key="data")
gjok_3 = GetJSONObjectKey(JObject=gjok_2, Key="ss")
gjok_4 = GetJSONObjectKey(JObject=gjok_2, Key="s1")
gjok_5 = GetJSONObjectKey(JObject=gjok_2, Key="sms")
gjok_6 = GetJSONObjectKey(JObject=gjok_2, Key="sm1")
gjok_7 = GetJSONObjectKey(JObject=gjok_2, Key="sds")
gjok_8 = GetJSONObjectKey(JObject=gjok_2, Key="sd1")
rjv = ReadJSONValue(JValue=gjok_3)  # -> AsString, AsNumber, AsBool
rjv_2 = ReadJSONValue(JValue=gjok_4)  # -> AsString, AsNumber, AsBool
rjv_3 = ReadJSONValue(JValue=gjok_5)  # -> AsString, AsNumber, AsBool
rjv_4 = ReadJSONValue(JValue=gjok_6)  # -> AsString, AsNumber, AsBool
rjv_5 = ReadJSONValue(JValue=gjok_7)  # -> AsString, AsNumber, AsBool
rjv_6 = ReadJSONValue(JValue=gjok_8)  # -> AsString, AsNumber, AsBool
panel_9 = Panel(rjv.AsString)
panel_10 = Panel(rjv_2.AsString)
panel_11 = Panel(rjv_5.AsString)
panel_12 = Panel(rjv_3.AsString)
panel_13 = Panel(rjv_4.AsString)
panel_14 = Panel(rjv_6.AsString)

merge_2 = Merge(Data1=panel_5, Data2=panel_6, Data3=item_8, Data4=item_9, Data5=item_10, Data6=rep, Data7=item_12)
merge_3 = Merge(
    Data1=flatten(merge_2),
    Data2=flatten(panel_9),
    Data3=flatten(panel_10),
    Data4=flatten(panel_12),
    Data5=flatten(panel_13),
    Data6=flatten(panel_11),
    Data7=flatten(panel_14))
merge_4 = Merge(
    Data1="Lat",
    Data2="Lon",
    Data3="Address",
    Data4="Height",
    Data5="Year",
    Data6="Occupancy",
    Data7="Structural Type",
    Data8="ss",
    Data9="s1",
    Data10="sms",
    Data11="sm1",
    Data12="sds",
    Data13="sd1")

# ---- group: writer / compile dataset
panel_15 = Panel("C:\Users\sxmoore\Source\AECTechSeattle\seismic.csv")

# ---- group: writer
join = TextJoin(Text=merge_3, Join=",")
join_2 = TextJoin(Text=merge_4, Join=",")
export_robotmotion_3_r3_multi = PythonScript(toggle=Toggle(False), path=panel_15, x=join, labs=join_2, y=Slider(1, range=0..10))
# ---------- export_robotmotion_3_r3_multi: Python ----------
#script by Gabriella Rossi / CITA
import os
from os import listdir
from os.path import isfile, join
from scriptcontext import sticky as st

if True:
    #Create file
    filename = str(path)
    fil = open(filename, 'a+')
    
    if y < 1 :

        #write header and first line
        fil.write(labs)
        fil.write('\n' + x)
    else:
        #just write line
        fil.write('\n' + x)

    fil.close()
# ---------- end export_robotmotion_3_r3_multi ----------
