# Grasshopper definition calc logic baseline - AB.gh (Grasshopper 1.0.7)

list = ValueList({"S-EBF", "S-EBF (CONN)", "S-SCBF", "S-OCBF", "S-RCSW", "O-RCSW", "S-SMF", "S-IMF", "S-OMF", "S-RCMF", "I-RCMF", "O-RCMF"}, selected="O-RCSW")
max_plan_dimension_ft = Number("139")

year_of_building = Number("1994")
height_ft = Number("295")
sfrs = Text(list)

lat = Number()
long = Number()
ss = Number()
s1 = Number("0.6")
ie = Number(1)
sms = Number()
sm1 = Number()
s1_2 = Number("0.6")
ie_2 = Number("1")
sds = Number("1.2")
sd1 = Number("1")
tl = Integer("12")
sds_2 = Number("1.2")
height_ft_2 = Number("295")
sd1_2 = Number("1")
tl_2 = Integer("12")
sfrs_2 = Panel("""S-EBF
S-EBF (CONN)
S-SCBF
S-OCBF
S-RCSW
O-RCSW
S-SMF
S-IMF
S-OMF
S-RCMF
I-RCMF
O-RCMF""")

# ---- group: Applicable Code Year
year_of_building_2 = Number(year_of_building)
codes = Integer([1961, 1964, 1967, 1970, 1973, 1976, 1979, 1982, 1985, 1988, 1991, 1994, 1997, 2005, 2010, 2016, 2022])
smaller = SmallerThan(FirstNumber=year_of_building_2, SecondNumber=codes)  # -> SmallerThan, OrEqualTo
larger = LargerThan(FirstNumber=year_of_building_2, SecondNumber=codes)  # -> LargerThan, OrEqualTo
cull = CullPattern(List=codes, CullPattern=larger.OrEqualTo)
item = ListItem(List=cull, Index="-1", Wrap=True)
panel = Panel(item)
index = ItemIndex(List=codes, Item=item)

# ----
panel_2 = Panel(codes)
_2016 = Panel("""8
0
6
3.25
6
5
8
4.5
3.5
8
5
3""")

# ---- group: ASCE 7-16
sfrs_3 = Panel(sfrs_2)
panel_3 = Panel(sfrs)
ct = Panel("""0.03
0.03
0.03
0.03
0.02
0.02
0.028
0.028
0.028
0.016
0.016
0.016""")
x = Panel("""0.75
0.75
0.75
0.75
0.75
0.75
0.8
0.8
0.8
0.9
0.9
0.9""")
keysearch = KeyValueSearch(Keys=sfrs_3, Values=x, Search=panel_3)
keysearch_2 = KeyValueSearch(Keys=sfrs_3, Values=_2016, Search=panel_3)
keysearch_3 = KeyValueSearch(Keys=sfrs_3, Values=ct, Search=panel_3)
num = Number(keysearch_2)
expression = Expression(ct=keysearch_3, h=height_ft, x=keysearch, Expression="ct*(h^x)")
python = GhPythonScript(sds=sds, r=num, ie=ie, sd1=sd1, tl=tl, ta=expression)  # -> cs
# ---------- python: Python ----------
__author__ = "ABawiskar"
__version__ = "2023.06.24"

import rhinoscriptsyntax as rs

if (ta<tl):
    cs_max = sd1/(ta*r/ie)
else:
    cs_max = sd1*tl/((ta**2)(r/ie))

cs_min = max(0.01,0.044*sds*ie)

cs = sds/(r/ie)

if (s1>=0.6):
    cs_min = max(cs_min,0.51*s1/(r/ie))

cs = min(max(cs_min, cs),cs_max)
# ---------- end python ----------
panel_4 = Panel(python)

# ---- group: Determine R-Value
_1982 = Panel("""10
0
0
6
0
8
12
0
6
12
7
5""")
_1985 = Panel("""10
0
0
6
0
8
12
0
6
12
7
5""")
_1979 = Panel("""0.8
0
0
0.8
0.67
0.8
0
0.67
0.8
0
0.67
0.8""")
_1991 = Panel("""10
0
0
8
0
8
12
0
6
12
8
5""")
_1988 = Panel("""10
0
0
6
0
8
12
0
6
12
7
5""")
_1997 = Panel("""7
0
0
5.6
0
5.5
8.5
0
4.5
8.5
5.5
3.5""")
_1994 = Panel("""10
0
9
8
0
8
12
0
6
12
8
5""")
_2016_2 = Panel("""8
0
6
3.25
6
5
8
4.5
3.5
8
5
3""")
_2005 = Panel("""8
7
6
3.25
6
5
8
4.5
3.5
8
5
3""")
_2010 = Panel("""8
0
6
3.25
6
5
8
4.5
3.5
8
5
3""")
filter = StreamFilter(
    Gate=index,
    Stream6=_1979,
    Stream7=_1982,
    Stream8=_1985,
    Stream9=_1988,
    Stream10=_1991,
    Stream11=_1994,
    Stream12=_1997,
    Stream13=_2005,
    Stream14=_2010,
    Stream15=_2016_2)
sfrs_4 = Text(sfrs)
keysearch_4 = KeyValueSearch(Keys=sfrs_2, Values=filter, Search=sfrs_4)
panel_5 = Panel(keysearch_4)

# ----
num_2 = Number(keysearch_4)

# ---- group: ASCE 7-10
x_2 = Panel("""0.8
0.8
0.8
0.8
0.9
0.9
0.75
0.75
0.75
0.75
0.75
0.75""")
ct_2 = Panel("""0.028
0.028
0.028
0.028
0.016
0.016
0.03
0.03
0.03
0.02
0.02
0.02""")
keysearch_5 = KeyValueSearch(Keys=sfrs_2, Values=ct_2, Search=sfrs)
keysearch_6 = KeyValueSearch(Keys=sfrs_2, Values=x_2, Search=sfrs)
expression_2 = Expression(ct=keysearch_5, h=height_ft_2, x=keysearch_6, Expression="ct*(h^x)")
panel_6 = Panel(expression_2)
python_2 = GhPythonScript(sds=sds_2, r=num_2, ie=ie_2, sd1=sd1_2, tl=tl_2, ta=expression_2, s1=s1_2)  # -> cs
# ---------- python_2: Python ----------
__author__ = "ABawiskar"
__version__ = "2023.06.24"

import rhinoscriptsyntax as rs

if (ta<tl):
    cs_max = sd1/(ta*r/ie)
else:
    cs_max = sd1*tl/((ta^2)(r/ie))

cs_min = max(0.01,0.044*sds*ie)

cs = sds/(r/ie)

if (s1>=0.6):
    cs_min = max(cs_min,0.51*s1/(r/ie))

cs = min(max(cs_min, cs),cs_max)
# ---------- end python_2 ----------
panel_7 = Panel(python_2)

# ---- group: UBC - 1988
x_3 = Panel("""0.75
0.75
0.75
0.75
0.75
0.75
0.75
0.75
0.75
0.75
0.75
0.75""")
ct_3 = Panel("""0.035
0.035
0.035
0.035
0.030
0.030
0.02
0.02
0.02
0.02
0.02
0.02""")
keysearch_7 = KeyValueSearch(Keys=sfrs_2, Values=ct_3, Search=sfrs)
keysearch_8 = KeyValueSearch(Keys=sfrs_2, Values=x_3, Search=sfrs)
expression_3 = Expression(ct=keysearch_7, h=height_ft_2, x=keysearch_8, Expression="ct*(h^x)")
expression_4 = Expression(S="1.5", ta=expression_3, Expression="1.25*S/(ta^(2/3))")
panel_8 = Panel(expression_3)
num_3 = Number(num_2)
multiplication = Multiplication(A="0.075", B=num_3)
min = Minimum(A=expression_4, B="2.75")
num_4 = Number("0.4")
max = Maximum(A=min, B=multiplication)
num_5 = Number(max)
python_3 = GhPythonScript(Z=num_4, I=ie_2, C=num_5, Rw=num_3)  # -> cs
# ---------- python_3: Python ----------
"""Provides a scripting component.
    Inputs:
        Z: The Z script variable
        I: The I script variable
        C: The C script variable
        Rw: The Rw script variable
    Output:
        cs: The a output variable"""

__author__ = "ABawiskar"
__version__ = "2023.06.24"

import rhinoscriptsyntax as rs

cs = Z*I*C/Rw
# ---------- end python_3 ----------
panel_9 = Panel(python_3)

# ---- group: ACI 7-05
ct_4 = Panel("""0.028
0.028
0.028
0.028
0.016
0.016
0.03
0.03
0.03
0.02
0.02
0.02""")
x_4 = Panel("""0.8
0.8
0.8
0.8
0.9
0.9
0.75
0.75
0.75
0.75
0.75
0.75""")
keysearch_9 = KeyValueSearch(Keys=sfrs_2, Values=ct_4, Search=sfrs)
keysearch_10 = KeyValueSearch(Keys=sfrs_2, Values=x_4, Search=sfrs)
expression_5 = Expression(ct=keysearch_9, h=height_ft_2, x=keysearch_10, Expression="ct*(h^x)")
panel_10 = Panel(expression_5)
python_4 = GhPythonScript(sds=sds_2, r=num_2, ie=ie_2, sd1=sd1_2, tl=tl_2, ta=expression_5, s1=s1_2)  # -> cs
# ---------- python_4: Python ----------
__author__ = "ABawiskar"
__version__ = "2023.06.24"

import rhinoscriptsyntax as rs

if (ta<tl):
    cs_max = sd1/(ta*r/ie)
else:
    cs_max = sd1*tl/((ta^2)(r/ie))

cs_min = 0.01

cs = sds/(r/ie)

if (s1>=0.6):
    cs_min = max(cs_min,0.51*s1/(r/ie))

cs = min(max(cs_min, cs),cs_max)
# ---------- end python_4 ----------
panel_11 = Panel(python_4)

# ---- group: UBC - 1982
expression_6 = Expression(D=max_plan_dimension_ft, h=height_ft_2, Expression="0.05*h/sqrt(D)")
panel_12 = Panel(expression_6)
expression_7 = Expression(ta=expression_6, Expression="1/(15*sqrt(ta))")
min_2 = Minimum(A=expression_7, B="0.12")
num_6 = Number(num_2)
num_7 = Number("1.5")
num_8 = Number("1")
num_9 = Number(min_2)
python_5 = GhPythonScript(Z=num_8, I=ie_2, C=num_9, K=num_6, S=num_7)  # -> cs
# ---------- python_5: Python ----------
"""Provides a scripting component.
    Inputs:
        Z: The Z script variable
        I: The I script variable
        C: The C script variable
        K: The Rw script variable
    Output:
        cs: The a output variable"""

__author__ = "ABawiskar"
__version__ = "2023.06.24"

import rhinoscriptsyntax as rs

C_S = min(C*S, 0.14)

cs = Z*I*C_S*K
# ---------- end python_5 ----------
panel_13 = Panel(num_9)
panel_14 = Panel(python_5)

# ---- group: UBC - 1994
ct_5 = Panel("""0.03
0.03
0.03
0.03
0.02
0.02
0.035
0.035
0.035
0.03
0.03
0.03""")
keysearch_11 = KeyValueSearch(Keys=sfrs_2, Values=ct_5, Search=sfrs)
num_10 = Number(keysearch_11)
python_6 = GhPythonScript(ie=ie, r=num_2, h=height_ft, ct=num_10)  # -> cs
# ---------- python_6: Python ----------
__author__ = "ABawiskar"
__version__ = "2023.06.24"

import rhinoscriptsyntax as rs
import math

t = ct*(h**0.75)
c=min((1.25*1.2/(t**(2/3))),2.75)
cs = 0.4*ie*c/r
# ---------- end python_6 ----------

# ---- group: UBC - 1997
ct_6 = Panel("""0.03
0.03
0.03
0.03
0.02
0.02
0.035
0.035
0.035
0.03
0.03
0.03""")
keysearch_12 = KeyValueSearch(Keys=sfrs_2, Values=ct_6, Search=sfrs)
num_11 = Number(keysearch_12)
python_7 = GhPythonScript(ie=ie, r=num_2, h=height_ft, ct=num_11)  # -> cs
# ---------- python_7: Python ----------
__author__ = "ABawiskar"
__version__ = "2023.06.24"

import rhinoscriptsyntax as rs
import math

cs_max = 2.5*0.44*(ie/r)
cs_min = 0.8*0.4*(ie/r)

ta = ct*(h**0.75)
cs = 0.64*ie/(r*ta)

cs = min(max(cs_min,cs),cs_max)
# ---------- end python_7 ----------

# ---- group: UBC -1979
num_12 = Number(python_5)

# ---- group: UBC - 1991
num_13 = Number(python_6)

# ----
panel_15 = Panel(python_7)
panel_16 = Panel(python_6)
panel_17 = Panel(num_12)
panel_18 = Panel(num_13)
filter_2 = StreamFilter(
    Gate=index,
    Stream6=num_12,
    Stream7=python_5,
    Stream8=_1985,
    Stream9=python_3,
    Stream10=num_13,
    Stream11=python_6,
    Stream12=python_7,
    Stream13=python_4,
    Stream14=python_2,
    Stream15=python)
cs = Number(filter_2)
panel_19 = Panel(cs)
