# Grasshopper definition calc logic baseline - NX.gh (Grasshopper 1.0.7)

year_of_construction = Integer()
ss = Number()
s1 = Number("0.6")
sms = Number()
ie = Number("1")
sm1 = Number()
sds = Number("1.2")
sfrs = Text()
height_ft = Number("295")
sd1 = Number("1")
lat = Number()
long = Number()
tl = Integer("12")
codes = Integer([1961, 1964, 1967, 1970, 1973, 1976, 1979, 1982, 1985, 1988, 1991, 1994, 1997, 2005, 2010, 2016, 2022])
larger = LargerThan(FirstNumber="1987", SecondNumber=codes)  # -> LargerThan, OrEqualTo
smaller = SmallerThan(FirstNumber="1987", SecondNumber=codes)  # -> SmallerThan, OrEqualTo
cull = CullPattern(List=codes, CullPattern=larger.OrEqualTo)
item = ListItem(List=cull, Index="-1", Wrap=True)
panel = Panel(item)
max_plan_dimension_ft = Number("139")

# ---- group: ASCE 7-16 / ASCE 7-10
panel_2 = Panel("""SMF
CMF
SEBF
SBRB
OTHER""")
x = Panel("""0.8
0.9
0.75
0.75
0.75""")
ct = Panel("""0.028
0.016
0.03
0.03
0.02""")
keysearch = KeyValueSearch(Keys=panel_2, Values=ct, Search="CMF")
keysearch_2 = KeyValueSearch(Keys=panel_2, Values=x, Search="CMF")
r = Panel("""3.5
3
5
8
3.5""")
expression = Expression(ct=keysearch, h=height_ft, x=keysearch_2, Expression="ct*(h^x)")
keysearch_3 = KeyValueSearch(Keys=panel_2, Values=r, Search="CMF")
panel_3 = Panel(expression)
num = Number(keysearch_3)
python = GhPythonScript(sds=sds, r=num, ie=ie, sd1=sd1, tl=tl, ta=expression, s1=s1)  # -> cs
# ---------- python: Python ----------
__author__ = "ABawiskar"
__version__ = "2023.06.24"

import rhinoscriptsyntax as rs

if (ta<tl):
    cs_max = sd1/(ta*r/ie)
else:
    cs_max = sd1*tl/((ta^2)(r/ie))

cs_min = max(0.01,0.044*sds*ie)

cs = sds/(r/ie)

if (s1>=0.6):
    cs_min = max(cs_min,0.51*s1/(r/ie))

cs = min(max(cs_min, cs),cs_max)
# ---------- end python ----------
panel_4 = Panel(python)

# ---- group: ASCE 7-16 / ASCE 7-05
panel_5 = Panel("""SMF
CMF
SEBF
SBRB
OTHER""")
x_2 = Panel("""0.8
0.9
0.75
0.75
0.75""")
ct_2 = Panel("""0.028
0.016
0.03
0.02
0.02""")
keysearch_4 = KeyValueSearch(Keys=panel_5, Values=ct_2, Search="CMF")
keysearch_5 = KeyValueSearch(Keys=panel_5, Values=x_2, Search="CMF")
r_2 = Panel("""3.5
3
5
8
3.5""")
expression_2 = Expression(ct=keysearch_4, h=height_ft, x=keysearch_5, Expression="ct*(h^x)")
keysearch_6 = KeyValueSearch(Keys=panel_5, Values=r_2, Search="CMF")
panel_6 = Panel(expression_2)
num_2 = Number(keysearch_6)
python_2 = GhPythonScript(sds=sds, r=num_2, ie=ie, sd1=sd1, tl=tl, ta=expression_2, s1=s1)  # -> cs
# ---------- python_2: Python ----------
__author__ = "ABawiskar"
__version__ = "2023.06.24"

import rhinoscriptsyntax as rs

if (ta<tl):
    cs_max = sd1/(ta*r/ie)
else:
    cs_max = sd1*tl/((ta^2)(r/ie))

cs_min = 0.01

cs = sds/(r/ie)

if (s1>=0.6):
    cs_min = max(cs_min,0.51*s1/(r/ie))

cs = min(max(cs_min, cs),cs_max)
# ---------- end python_2 ----------
panel_7 = Panel(python_2)

# ----
num_3 = Number("1")
filter = StreamFilter(Gate=0)

# ---- group: UBC-1988
panel_8 = Panel("""SMF
CMF
SEBF
SBRB
OTHER""")
x_3 = Panel("""0.75
0.75
0.75
0.75
0.75""")
ct_3 = Panel("""0.035
0.030
0.02
0.02
0.02""")
keysearch_7 = KeyValueSearch(Keys=panel_8, Values=ct_3, Search="CMF")
keysearch_8 = KeyValueSearch(Keys=panel_8, Values=x_3, Search="CMF")
r_3 = Panel("""3.5
5
5
8
3.5""")
expression_3 = Expression(ct=keysearch_7, h=height_ft, x=keysearch_8, Expression="ct*(h^x)")
keysearch_9 = KeyValueSearch(Keys=panel_8, Values=r_3, Search="CMF")
panel_9 = Panel(expression_3)
num_4 = Number(keysearch_9)

expression_4 = Expression(S="1", ta=expression_3, Expression="1.25*S/(ta^(2/3))")
multiplication = Multiplication(A="0.075", B=num_4)
min = Minimum(A=expression_4, B="2.75")
num_5 = Number("0.4")
max = Maximum(A=min, B=multiplication)
num_6 = Number(max)

python_3 = GhPythonScript(Z=num_5, I=ie, C=num_6, Rw=num_4)  # -> cs
# ---------- python_3: Python ----------
"""Provides a scripting component.
    Inputs:
        Z: The Z script variable
        I: The I script variable
        C: The C script variable
        Rw: The Rw script variable
    Output:
        cs: The a output variable"""

__author__ = "ABawiskar"
__version__ = "2023.06.24"

import rhinoscriptsyntax as rs

cs = Z*I*C/Rw
# ---------- end python_3 ----------
panel_10 = Panel(python_3)

# ---- group: UBC-1982 / UBC-1988
panel_11 = Panel("""SMF
CMF
SEBF
SBRB
OTHER""")
x_4 = Panel("""0.75
0.75
0.75
0.75
0.75""")
expression_5 = Expression(D=max_plan_dimension_ft, h=height_ft, Expression="0.05*h/sqrt(D)")
keysearch_10 = KeyValueSearch(Keys=panel_11, Values=x_4, Search="CMF")
r_4 = Panel("""3.5
0.67
5
8
3.5""")
keysearch_11 = KeyValueSearch(Keys=panel_11, Values=r_4, Search="CMF")
panel_12 = Panel(expression_5)
num_7 = Number(keysearch_11)

# ---- group: UBC-1982
expression_6 = Expression(ta=expression_5, Expression="1/(15*sqrt(ta))")
min_2 = Minimum(A=expression_6, B="0.12")
num_8 = Number("1")
num_9 = Number(min_2)

# ---- group: UBC-1982 / UBC-1988 (continued)
python_4 = GhPythonScript(Z=num_8, I=ie, C=num_9, K=num_7, S=num_3)  # -> cs
# ---------- python_4: Python ----------
"""Provides a scripting component.
    Inputs:
        Z: The Z script variable
        I: The I script variable
        C: The C script variable
        K: The Rw script variable
    Output:
        cs: The a output variable"""

__author__ = "ABawiskar"
__version__ = "2023.06.24"

import rhinoscriptsyntax as rs

C_S = min(C*S, 0.14)
K = max(0.12/C, min(0.25/C, K))

cs = Z*I*C_S*K
# ---------- end python_4 ----------
panel_13 = Panel(python_4)

# ----
panel_14 = Panel(num_7)
panel_15 = Panel(num_9)
