# Grasshopper definition calc logic baseline - PKK.gh (Grasshopper 1.0.7)

year_of_building = Number("1987")
height_ft = Number("150")
sfrs = Text("S-EBF")
sds = Number("1.2")

# ---- group: Applicable Code Year
year_of_building_2 = Number(year_of_building)
codes = Integer([1961, 1964, 1967, 1970, 1973, 1976, 1979, 1982, 1985, 1988, 1991, 1994, 1997, 2005, 2010, 2016, 2022])
smaller = SmallerThan(FirstNumber=year_of_building_2, SecondNumber=codes)  # -> SmallerThan, OrEqualTo
larger = LargerThan(FirstNumber=year_of_building_2, SecondNumber=codes)  # -> LargerThan, OrEqualTo
panel = Panel(codes)
cull = CullPattern(List=codes, CullPattern=larger.OrEqualTo)
item = ListItem(List=cull, Index="-1", Wrap=True)
panel_2 = Panel(item)
index = ItemIndex(List=codes, Item=item)

# ----
sfrs_2 = Panel("""S-EBF
S-EBF (CONN)
S-SCBF
S-OCBF
S-RCSW
O-RCSW
S-SMF
S-IMF
S-OMF
S-RCMF
I-RCMF
O-RCMF""")
_2016 = Panel("""8
0
6
3.25
6
5
8
4.5
3.5
8
5
3""")

# ---- group: ASCE 7-16
panel_3 = Panel(sfrs)
x = Panel("""0.8
0.9
0.75
0.75
0.75""")
ct = Panel("""0.028
0.016
0.03
0.03
0.02""")
keysearch = KeyValueSearch(Values=x, Search=panel_3)
keysearch_2 = KeyValueSearch(Values=ct, Search=panel_3)
expression = Expression(ct=keysearch_2, h=height_ft, x=keysearch, Expression="ct*(h^x)")
keysearch_3 = KeyValueSearch(Keys=sfrs_2, Values=_2016, Search=panel_3)
panel_4 = Panel(expression)
num = Number(keysearch_3)
python = GhPythonScript(r=num, ta=expression)  # -> cs
# ---------- python: Python ----------
__author__ = "ABawiskar"
__version__ = "2023.06.24"

import rhinoscriptsyntax as rs

if (ta<tl):
    cs_max = sd1/(ta*r/ie)
else:
    cs_max = sd1*tl/((ta^2)(r/ie))

cs_min = max(0.01,0.044*sds*ie)

cs = sds/(r/ie)

if (s1>=0.6):
    cs_min = max(cs_min,0.51*s1/(r/ie))

cs = min(max(cs_min, cs),cs_max)
# ---------- end python ----------
panel_5 = Panel(python)

# ---- group: Determine R-Value
_1982 = Panel("""10
0
0
6
0
8
12
0
6
12
7
5""")
_1985 = Panel("""10
0
0
6
0
8
12
0
6
12
7
5""")
_1979 = Panel("""0.8
0
0
0.8
0.67
0.8
0
0.67
0.8
0
0.67
0.8""")
_1988 = Panel("""10
0
0
6
0
8
12
0
6
12
7
5""")
_1997 = Panel("""7
0
0
5.6
0
5.5
8.5
0
4.5
8.5
5.5
3.5""")
_1991 = Panel("""10
0
0
8
0
8
12
0
6
12
8
5""")
_1994 = Panel("""10
0
9
8
0
8
12
0
6
12
8
5""")
_2010 = Panel("""8
0
6
3.25
6
5
8
4.5
3.5
8
5
3""")
_2016_2 = Panel("""8
0
6
3.25
6
5
8
4.5
3.5
8
5
3""")
_2005 = Panel("""8
7
6
3.25
6
5
8
4.5
3.5
8
5
3""")
filter = StreamFilter(
    Gate=index,
    Stream6=_1979,
    Stream7=_1982,
    Stream8=_1985,
    Stream9=_1988,
    Stream10=_1991,
    Stream11=_1994,
    Stream12=_1997,
    Stream13=_2005,
    Stream14=_2010,
    Stream15=_2016_2)
sfrs_3 = Panel("""S-EBF
S-EBF (CONN)
S-SCBF
S-OCBF
S-RCSW
O-RCSW
S-SMF
S-IMF
S-OMF
S-RCMF
I-RCMF
O-RCMF""")
sfrs_4 = Text(sfrs)
keysearch_4 = KeyValueSearch(Keys=sfrs_3, Values=filter, Search=sfrs_4)
panel_6 = Panel(keysearch_4)
